# Grasshopper definition 181116_des_fab.gh (Grasshopper 0.9.76)
# plug-ins: Python Interpreter

# ----
# PATTERN
srf = Surface(<surface referenced from the Rhino model>)
ext_srf = ExtSrf(S=srf)
output_s = Surface(ext_srf)

# ----
# TODO: -Interface with line color of pattern for real time evaluation of fittness to branch population
# 
# -Integrate with old design file with target surface, pattern, mathcing, assignment etc.
# 
# -Use laptop camera or other for reading pose (depth not necessary)
#     -Integrate that with grasshopper
# 
# -Simulation
# 
# -Test run fabricate triangle
swatch = ColourSwatch(SwatchColor=RGB(25, 0, 255))

number_slider = Slider(3, range=0..20)
number_slider_2 = Slider(3, range=0..20)
alfa = Slider(25, range=-40..40)
alfa_2 = Number(alfa)
sdiv_equi = PythonScript(S=srf, U=number_slider, V=number_slider_2)  # -> simplify(P); inputs S: Surface
# ---------- sdiv_equi: Python ----------
import rhinoscriptsyntax as rs
import math
import Rhino.Geometry as rg
from clr import AddReference as addr
addr("Grasshopper")
from System import Object
from Grasshopper import DataTree
from Grasshopper.Kernel.Data import GH_Path

def raggedListToDataTree(raggedList):
    rl = raggedList
    result = DataTree[object]()
    for i in range(len(rl)):
        temp = []
        for j in range(len(rl[i])):
            temp.append(rl[i][j])
        #print i, " - ",temp
        path = GH_Path(i)
        result.AddRange(temp, path)
    return result

def add_rotate_line(pt0,pt1):
    ln = rs.AddLine(pt0,pt1)
    # Rotate line around its mid point
    mid = rs.CurveMidPoint(ln)
    uv = rs.SurfaceClosestPoint(S,mid)
    axis = rs.SurfaceNormal(S,uv)
    rs.RotateObject(ln,mid,alfa,axis)
    # Extend line
    rs.ExtendCurveLength(ln,0,0,ext)
    rs.ExtendCurveLength(ln,0,1,ext)
    # Project line to surface
    # ln = rs.ProjectCurveToSurface(ln,S,axis)
    return ln


u_step = 1.00/U
v_step = 1.00/V

U = int(U)
V = int(V)

# Creat grid of points on surface
pts = []
for i in range(U+1):
    u_ = u_step * i
    temp = []
    for j in range(V+1):
        v_ = v_step * j
        (u,v) = rs.SurfaceParameter(S,(u_,v_))
        pt = rs.EvaluateSurface(S, u, v,)
        temp.append(pt)
    pts.append(temp)

# Make division equidistance
pts = zip(*pts)
for i in range(len(pts)):
    crv = rs.AddInterpCrvOnSrf(S,pts[i])
    pts[i] = rs.DivideCurve(crv,U)
    #pts[i].append(rs.CurveEndPoint(crv))
pts = zip(*pts)
for i in range(len(pts)):
    #crv = rs.AddInterpCrvOnSrf(S,pts[i])
    crv = rs.AddInterpCurve(pts[i])
    pts[i] = rs.DivideCurve(crv,V)
    #pts[i].append(rs.CurveEndPoint(crv))
pts = zip(*pts)

P = raggedListToDataTree(pts)
# ---------- end sdiv_equi ----------
sdivide = DivideSurface(Surface=srf, UCount=number_slider, VCount=number_slider_2)  # -> simplify(Points), Normals, Parameters

cluster_edge_pts = ClusterEdgePts(S=output_s, P=sdiv_equi)  # disabled
number_slider_3 = Slider(1, range=-1..1)  # disabled
pattern_1 = PythonScript(S=output_s, P=cluster_edge_pts, alfa=alfa_2, dir=number_slider_3)  # -> L1, L2; inputs S: Surface, P: tree; disabled
# ---------- pattern_1: Python ----------
import rhinoscriptsyntax as rs
import math
import Rhino.Geometry as rg
from clr import AddReference as addr
addr("Grasshopper")
from System import Object
from Grasshopper import DataTree
from Grasshopper.Kernel.Data import GH_Path

def dataTreeToList(aTree):
    theList = []
    for i in range(aTree.BranchCount ):
        thisListPart = []
        thisBranch = aTree.Branch(i)
        for j in range(len(thisBranch)):
            thisListPart.append( thisBranch[j] )
        theList.append(thisListPart)
    return theList
    
def raggedListToDataTree(raggedList):
    rl = raggedList
    result = DataTree[object]()
    for i in range(len(rl)):
        temp = []
        for j in range(len(rl[i])):
            temp.append(rl[i][j])
        #print i, " - ",temp
        path = GH_Path(i)
        result.AddRange(temp, path)
    return result

def point_to_surface(pt):
    (u,v) = rs.SurfaceClosestPoint(S,pt)
    pt = rs.EvaluateSurface(S,u,v)
    return pt

def add_rotate_line(pt0,pt1):
    ln = rs.AddLine(pt0,pt1)
    # Rotate line around its mid point
    mid = rs.CurveMidPoint(ln)
    uv = rs.SurfaceClosestPoint(S,mid)
    axis = rs.SurfaceNormal(S,uv)
    rs.RotateObject(ln,mid,alfa,dir*axis)
    # Project line endpoints to surface
    st = point_to_surface(rs.CurveStartPoint(ln))
    en = point_to_surface(rs.CurveEndPoint(ln))
    ln = rs.AddLine(st,en)
    # ln = rs.ProjectCurveToSurface(ln,S,axis)
    # Extend line
    #rs.ExtendCurveLength(ln,0,0,ext)
    #rs.ExtendCurveLength(ln,0,1,ext)
    return ln

P = dataTreeToList(P)

# Create rotated lines along V direction
L1 = []
for i in range(1,len(P)-1):
    temp = []
    for j in range(len(P[i])-1):
        p0 = P[i][j]
        p1 = P[i][j+1]
        line = add_rotate_line(p0,p1)
        temp.append(line)
    L1.append(temp)

# Create rotated lines along U direction
L2 = []
for i in range(len(P)-1):
    temp = []
    for j in range(1,len(P[i])-1):
        p0 = P[i][j]
        p1 = P[i+1][j]
        line = add_rotate_line(p0,p1)
        temp.append(line)
    L2.append(temp)

L1 = raggedListToDataTree(L1)
L2 = raggedListToDataTree(L2)
# ---------- end pattern_1 ----------
number_slider_4 = Slider(5, range=0..10)  # disabled
number_slider_5 = Slider(8, range=0..10)  # disabled
ext_proj_lines = PythonScript(S=output_s, L1=pattern_1.L1, L2=pattern_1.L2, n=number_slider_5)  # -> C1, C2; inputs S: list, L1: tree, L2: tree; disabled
# ---------- ext_proj_lines: Python ----------
import rhinoscriptsyntax as rs
import math
import Rhino.Geometry as rg
from clr import AddReference as addr
addr("Grasshopper")
from System import Object
from Grasshopper import DataTree
from Grasshopper.Kernel.Data import GH_Path

def dataTreeToList(aTree):
    theList = []
    for i in range(aTree.BranchCount ):
        thisListPart = []
        thisBranch = aTree.Branch(i)
        for j in range(len(thisBranch)):
            thisListPart.append( thisBranch[j] )
        theList.append(thisListPart)
    return theList
    
def raggedListToDataTree(raggedList):
    rl = raggedList
    result = DataTree[object]()
    for i in range(len(rl)):
        temp = []
        for j in range(len(rl[i])):
            temp.append(rl[i][j])
        #print i, " - ",temp
        path = GH_Path(i)
        result.AddRange(temp, path)
    return result

def curve_to_surface(crv):
    mid = rs.CurveMidPoint(crv)
    uv = rs.SurfaceClosestPoint(S[0],mid)
    norm = rs.SurfaceNormal(S[0],uv)
    pts = rs.DivideCurve(crv,n)
    for k in range(len(pts)):
        pt = pts[k]
        ppts = rs.ProjectPointToSurface(pt,S,norm)
        if ppts==None or len(ppts)==0:
            ppts = rs.ProjectPointToSurface(pt,S,-norm)
        if ppts!=None and len(ppts)>0:
            if len(ppts)==1: pt = ppts[0]
            else:
                (u,v) = rs.SurfaceClosestPoint(S[0],pt)
                cpt = rs.EvaluateSurface(S[0],u,v)
                mindist = 9999
                for ppt in ppts:
                    dist = rs.Distance(ppt,cpt)
                    if dist<mindist:
                        mindist = dist
                        pt = ppt
        else: 
            pt = None
            print "miss"
        pts[k] = pt
    pts2 = []
    for pt in pts:
        if pt!=None:
            pts2.append(pt)
    crv = rs.AddInterpCurve(pts2)
    return crv


C1 = dataTreeToList(L1)
C2 = dataTreeToList(L2)

ratio = 0.5


for i in range(len(C1)):
    for j in range(len(C1[0])):
        ln = C1[i][j]
        d = ratio*rs.CurveLength(ln)
        rs.ExtendCurveLength(ln,0,0,d)
        rs.ExtendCurveLength(ln,0,1,d)
        crv = curve_to_surface(ln)
        C1[i][j] = crv

for i in range(len(C2)):
    for j in range(len(C2[0])):
        ln = C2[i][j]
        d = ratio*rs.CurveLength(ln)
        rs.ExtendCurveLength(ln,0,0,d)
        rs.ExtendCurveLength(ln,0,1,d)
        crv = curve_to_surface(ln)
        C2[i][j] = crv

C1 = raggedListToDataTree(C1)
C2 = raggedListToDataTree(C2)
# ---------- end ext_proj_lines ----------
trim_ext_curves = PythonScript(S=output_s, C1=ext_proj_lines.C1, C2=ext_proj_lines.C2, ext=number_slider_4)  # -> C1, C2; inputs S: Surface, C1: tree, C2: tree
# ---------- trim_ext_curves: Python ----------
import rhinoscriptsyntax as rs
import math
import Rhino.Geometry as rg
from clr import AddReference as addr
addr("Grasshopper")
from System import Object
from Grasshopper import DataTree
from Grasshopper.Kernel.Data import GH_Path

def dataTreeToList(aTree):
    theList = []
    for i in range(aTree.BranchCount ):
        thisListPart = []
        thisBranch = aTree.Branch(i)
        for j in range(len(thisBranch)):
            thisListPart.append( thisBranch[j] )
        theList.append(thisListPart)
    return theList

def raggedListToDataTree(raggedList):
    rl = raggedList
    result = DataTree[object]()
    for i in range(len(rl)):
        temp = []
        for j in range(len(rl[i])):
            temp.append(rl[i][j])
        path = GH_Path(i)
        result.AddRange(temp, path)
    return result

def curve_cp(crv,pt):
    t = rs.CurveClosestPoint(crv,pt)
    pt = rs.EvaluateCurve(crv,t)
    return pt

def cut_at_boundaries(crv,boundary1,boundary2,tag):
    # Boundary 1
    t1 = rs.CurveClosestPoint(crv,rs.CurveStartPoint(crv))
    if boundary1!=None:
        X = rs.CurveCurveIntersection(crv,boundary1,10)
        if X!=None:
            X = X[0][1]
            t1 = rs.CurveClosestPoint(crv,X)
        else: 
            print "error",tag
            st = rs.CurveStartPoint(crv)
            st = curve_cp(boundary1,st)
            t1 = rs.CurveClosestPoint(crv,st)
    # Boundary 2
    t2 = rs.CurveClosestPoint(crv,rs.CurveEndPoint(crv))
    if boundary2!=None:
        X = rs.CurveCurveIntersection(crv,boundary2,10)
        if X!=None:
            X = X[0][1]
            t2 = rs.CurveClosestPoint(crv,X)
        else: 
            print "error",tag
            en = rs.CurveEndPoint(crv)
            en = curve_cp(boundary2,en)
            t2 = rs.CurveClosestPoint(crv,en)
    # Trim curve
    crv = rs.TrimCurve(crv,(t1,t2))
    return crv

C1 = dataTreeToList(C1)
C2 = dataTreeToList(C2)

C1_ = []
for crvs in C1:
    C1_.append(rs.CopyObjects(crvs))

for i in range(len(C1)):
    for j in range(len(C1[i])): 
        line = C1[i][j]
        if j==0:
            bound1 = C2[i+1][j]
            bound2 = C2[i][j] 
        elif j==len(C1[0])-1:
            bound1 = C2[i+1][j-1]
            bound2 = C2[i][j-1]
        else:
            bound1 = C2[i+1][j-1]
            bound2 = C2[i][j]
        polyline = cut_at_boundaries(line,bound1,bound2,"C1-"+str(j))
        C1[i][j] = polyline


for i in range(len(C2)):
    for j in range(len(C2[i])): 
        line = C2[i][j]
        if i==0:
            bound1 = C1_[i][j]
            bound2 = C1_[i][j+1]
        elif i==len(C2)-1:
            bound1 = C1_[i-1][j]
            bound2 = C1_[i-1][j+1]
        else:
            bound1 = C1_[i-1][j]
            bound2 = C1_[i][j+1]
        polyline = cut_at_boundaries(line,bound1,bound2,"C2-"+str(i))
        C2[i][j] = polyline

for crvs in C1:
    for crv in crvs:
        rs.ExtendCurveLength(crv,2,0,ext)
        rs.ExtendCurveLength(crv,2,1,ext)

for crvs in C2:
    for crv in crvs:
        rs.ExtendCurveLength(crv,2,0,ext)
        rs.ExtendCurveLength(crv,2,1,ext)


C1 = raggedListToDataTree(C1)
C2 = raggedListToDataTree(C2)
# ---------- end trim_ext_curves ----------

number_slider_6 = Slider(0, range=0..10)

pattern = PythonScript(S=output_s, P=sdiv_equi, alfa=alfa_2)  # -> L1, L2; inputs S: Surface, P: tree
# ---------- pattern: Python ----------
import rhinoscriptsyntax as rs
import math
import Rhino.Geometry as rg
from clr import AddReference as addr
addr("Grasshopper")
from System import Object
from Grasshopper import DataTree
from Grasshopper.Kernel.Data import GH_Path

def dataTreeToList(aTree):
    theList = []
    for i in range(aTree.BranchCount ):
        thisListPart = []
        thisBranch = aTree.Branch(i)
        for j in range(len(thisBranch)):
            thisListPart.append( thisBranch[j] )
        theList.append(thisListPart)
    return theList
    
def raggedListToDataTree(raggedList):
    rl = raggedList
    result = DataTree[object]()
    for i in range(len(rl)):
        temp = []
        for j in range(len(rl[i])):
            temp.append(rl[i][j])
        #print i, " - ",temp
        path = GH_Path(i)
        result.AddRange(temp, path)
    return result

def point_to_surface(pt):
    (u,v) = rs.SurfaceClosestPoint(S,pt)
    pt = rs.EvaluateSurface(S,u,v)
    return pt

def add_rotate_line(pt0,pt1):
    ln = rs.AddLine(pt0,pt1)
    # Rotate line around its mid point
    mid = rs.CurveMidPoint(ln)
    uv = rs.SurfaceClosestPoint(S,mid)
    axis = rs.SurfaceNormal(S,uv)
    rs.RotateObject(ln,mid,alfa,axis)
    # Project line endpoints to surface
    st = point_to_surface(rs.CurveStartPoint(ln))
    en = point_to_surface(rs.CurveEndPoint(ln))
    ln = rs.AddLine(st,en)
    # ln = rs.ProjectCurveToSurface(ln,S,axis)
    # Extend line
    #rs.ExtendCurveLength(ln,0,0,ext)
    #rs.ExtendCurveLength(ln,0,1,ext)
    return ln

P = dataTreeToList(P)

# Create rotated lines along V direction
L1 = []
for i in range(len(P)):
    temp = []
    for j in range(len(P[i])-1):
        p0 = P[i][j]
        p1 = P[i][j+1]
        line = add_rotate_line(p0,p1)
        temp.append(line)
    L1.append(temp)

# Create rotated lines along U direction
L2 = []
for i in range(len(P)-1):
    temp = []
    for j in range(len(P[i])):
        p0 = P[i][j]
        p1 = P[i+1][j]
        line = add_rotate_line(p0,p1)
        temp.append(line)
    L2.append(temp)

L1 = raggedListToDataTree(L1)
L2 = raggedListToDataTree(L2)
# ---------- end pattern ----------
ext_proj = PythonScript(S=output_s, L1=pattern.L1, L2=pattern.L2)  # -> C1, C2; inputs S: list, L1: tree, L2: tree
# ---------- ext_proj: Python ----------
import rhinoscriptsyntax as rs
import math
import Rhino.Geometry as rg
from clr import AddReference as addr
addr("Grasshopper")
from System import Object
from Grasshopper import DataTree
from Grasshopper.Kernel.Data import GH_Path

def dataTreeToList(aTree):
    theList = []
    for i in range(aTree.BranchCount ):
        thisListPart = []
        thisBranch = aTree.Branch(i)
        for j in range(len(thisBranch)):
            thisListPart.append( thisBranch[j] )
        theList.append(thisListPart)
    return theList
    
def raggedListToDataTree(raggedList):
    rl = raggedList
    result = DataTree[object]()
    for i in range(len(rl)):
        temp = []
        for j in range(len(rl[i])):
            temp.append(rl[i][j])
        #print i, " - ",temp
        path = GH_Path(i)
        result.AddRange(temp, path)
    return result

def curve_to_surface(crv):
    mid = rs.CurveMidPoint(crv)
    uv = rs.SurfaceClosestPoint(S[0],mid)
    norm = rs.SurfaceNormal(S[0],uv)
    pts = rs.DivideCurve(crv,n)
    for k in range(len(pts)):
        pt = pts[k]
        ppts = rs.ProjectPointToSurface(pt,S,norm)
        if ppts==None or len(ppts)==0:
            ppts = rs.ProjectPointToSurface(pt,S,-norm)
        if ppts!=None and len(ppts)>0:
            if len(ppts)==1: pt = ppts[0]
            else:
                (u,v) = rs.SurfaceClosestPoint(S[0],pt)
                cpt = rs.EvaluateSurface(S[0],u,v)
                mindist = 9999
                for ppt in ppts:
                    dist = rs.Distance(ppt,cpt)
                    if dist<mindist:
                        mindist = dist
                        pt = ppt
        else: 
            pt = None
            print "miss"
        pts[k] = pt
    pts2 = []
    for pt in pts:
        if pt!=None:
            pts2.append(pt)
    crv = rs.AddInterpCurve(pts2)
    return crv


C1 = dataTreeToList(L1)
C2 = dataTreeToList(L2)

ratio = 0.4
n = 12

for i in range(len(C1)):
    for j in range(len(C1[0])):
        ln = C1[i][j]
        d = ratio*rs.CurveLength(ln)
        rs.ExtendCurveLength(ln,0,0,d)
        rs.ExtendCurveLength(ln,0,1,d)
        crv = curve_to_surface(ln)
        C1[i][j] = crv

for i in range(len(C2)):
    for j in range(len(C2[0])):
        ln = C2[i][j]
        d = ratio*rs.CurveLength(ln)
        rs.ExtendCurveLength(ln,0,0,d)
        rs.ExtendCurveLength(ln,0,1,d)
        crv = curve_to_surface(ln)
        C2[i][j] = crv

C1 = raggedListToDataTree(C1)
C2 = raggedListToDataTree(C2)
# ---------- end ext_proj ----------
trim_ext_curves_2 = PythonScript(S=output_s, C1=flatten(ext_proj.C1), C2=flatten(ext_proj.C2), ext=Slider(5, range=0..10))  # -> IDEAL, XPTS; inputs S: Surface, C1: list, C2: list
# ---------- trim_ext_curves_2: Python ----------
import rhinoscriptsyntax as rs
import math
import Rhino.Geometry as rg
from clr import AddReference as addr
addr("Grasshopper")
from System import Object
from Grasshopper import DataTree
from Grasshopper.Kernel.Data import GH_Path

def dataTreeToList(aTree):
    theList = []
    for i in range(aTree.BranchCount ):
        thisListPart = []
        thisBranch = aTree.Branch(i)
        for j in range(len(thisBranch)):
            thisListPart.append( thisBranch[j] )
        theList.append(thisListPart)
    return theList

def raggedListToDataTree(raggedList):
    rl = raggedList
    result = DataTree[object]()
    for i in range(len(rl)):
        temp = []
        for j in range(len(rl[i])):
            temp.append(rl[i][j])
        path = GH_Path(i)
        result.AddRange(temp, path)
    return result

def curve_cp(crv,pt):
    t = rs.CurveClosestPoint(crv,pt)
    pt = rs.EvaluateCurve(crv,t)
    return pt


IDEAL = []
XPTS = []

C1_ = rs.CopyObjects(C1)

for crv in C1:
    T = []
    P = []
    for bound in C2:
        X = rs.CurveCurveIntersection(crv,bound,1)
        if X!=None and len(X)>0: 
            T.append(rs.CurveClosestPoint(crv,X[0][1]))
            P.append(X[0][1])
    stt = sorted(T)[0]
    ent = sorted(T)[-1]
    trimmed_crv = rs.SplitCurve(crv,(stt,ent))[1]
    IDEAL.append(trimmed_crv)
    XPTS.append(P)

for crv in C2:
    T = []
    P = []
    for bound in C1_:
        X = rs.CurveCurveIntersection(crv,bound,1)
        if X!=None and len(X)>0: 
            T.append(rs.CurveClosestPoint(crv,X[0][1]))
            P.append(X[0][1])
    stt = sorted(T)[0]
    ent = sorted(T)[-1]
    trimmed_crv = rs.SplitCurve(crv,(stt,ent))[1]
    IDEAL.append(trimmed_crv)
    XPTS.append(P)

for crv in IDEAL:
    rs.ExtendCurveLength(crv,2,0,ext)
    rs.ExtendCurveLength(crv,2,1,ext)

XPTS = raggedListToDataTree(XPTS)
# ---------- end trim_ext_curves_2 ----------

crv = Curve([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])
ideal_crvs = Curve(trim_ext_curves_2.IDEAL)
xpts_pts = Point(trim_ext_curves_2.XPTS)
number_slider_7 = Slider(1, range=0..10)
item = ListItem(List=ideal_crvs, Index=number_slider_7, Wrap=True)
python = PythonScript(L=xpts_pts, i=number_slider_7)  # -> item; inputs L: tree, i: Int32
# ---------- python: Python ----------
import rhinoscriptsyntax as rs
import Rhino.Geometry as rg
from clr import AddReference as addr
addr("Grasshopper")
from System import Object
from Grasshopper import DataTree
from Grasshopper.Kernel.Data import GH_Path

def dataTreeToList(aTree):
    theList = []
    for i in range(aTree.BranchCount ):
        thisListPart = []
        thisBranch = aTree.Branch(i)
        for j in range(len(thisBranch)):
            thisListPart.append( thisBranch[j] )
        theList.append(thisListPart)
    return theList

def raggedListToDataTree(raggedList):
    rl = raggedList
    result = DataTree[object]()
    for i in range(len(rl)):
        temp = []
        for j in range(len(rl[i])):
            temp.append(rl[i][j])
        #print i, " - ",temp
        path = GH_Path(i)
        result.AddRange(temp, path)
    return result

L = dataTreeToList(L)
item = L[i]
# ---------- end python ----------

number_slider_8 = Slider(2, range=0..10)
tol = Slider(0.1, range=0..0.2)
mill_dia = Slider(1, range=0..1)

xy = XYPlane(Origin=Point(0, 0, 0))
swatch_2 = ColourSwatch(SwatchColor=RGB(140, 0, 255))
origin_pt_milling_head = Point(Point(0, 0, 0))
tip = PythonScript()  # -> V
# ---------- tip: Python ----------
import rhinoscriptsyntax as rs

x = 2.5
y = -5
z = 20

V = rs.VectorCreate((x,y,z),(0,0,0))
# ---------- end tip ----------
marker_to_tip_vec = Vector(tip)
subtraction = Subtraction(A=origin_pt_milling_head, B=marker_to_tip_vec)

# ----
# MILLING HEAD
origin_pt_milling_head_2 = Point(Point(0, 0, 0))
cluster = Cluster(P=subtraction, A=mill_dia, F_2=Slider(6, range=0..10), A_2=subtraction, F=Slider(12, range=0..100))  # -> E, B
brep = Brep([cluster.E, cluster.B])

calibrating = BooleanToggle(True)

panel = Panel("C:\Users\hyoshdia\Dropbox\branch_transforms")
skel_crv_iii = Curve(<curve referenced from the Rhino model>)
skel_crv_ii = Curve(<curve referenced from the Rhino model>)
skel_crv_i = Curve(<curve referenced from the Rhino model>)
mesh_iii = Mesh(<mesh referenced from the Rhino model>)
mesh_ii = Mesh(<mesh referenced from the Rhino model>)
# REAL
mesh_i = Mesh(<mesh referenced from the Rhino model>)
merge = Merge(Data1=mesh_i, Data2=mesh_ii, Data3=mesh_iii)
merge_2 = Merge(Data1=skel_crv_i, Data2=skel_crv_ii, Data3=skel_crv_iii)
import = PythonScript(path=panel, refresh=Button())  # -> P, pose, name
# ---------- import: Python ----------
import rhinoscriptsyntax as rs
import math
import Rhino.Geometry as rg
from clr import AddReference as addr
addr("Grasshopper")
from System import Object
from Grasshopper import DataTree
from Grasshopper.Kernel.Data import GH_Path
import os

def dataTreeToList(aTree):
    theList = []
    for i in range(aTree.BranchCount ):
        thisListPart = []
        thisBranch = aTree.Branch(i)
        for j in range(len(thisBranch)):
            thisListPart.append( thisBranch[j] )
        theList.append(thisListPart)
    return theList

def raggedListToDataTree(raggedList):
    rl = raggedList
    result = DataTree[object]()
    for i in range(len(rl)):
        temp = []
        for j in range(len(rl[i])):
            temp.append(rl[i][j])
        #print i, " - ",temp
        path = GH_Path(i)
        result.AddRange(temp, path)
    return result

P = []
pose = []
name = []
files = os.listdir(path)
for file in files:
    file = file.split('.')[0]
    file = file.split('_')
    if file[0]=='0' and file[1]=='scan' and file[2]=='pose':
        if file[3] != 'miscellaneous': name.append(file[3])

for n in name:
    location = str(path)+'\\0_scan_pose_'+str(n)+'.txt'
    file = open(location,'r')
    lst = file.readlines()
    for i in range(len(lst)):
        lst[i] = lst[i].split(',')
        lst[i].pop()
        for j in range(len(lst[i])):
            lst[i][j] = float(lst[i][j])
    X = lst[0]
    Y = lst[1]
    Z = lst[2]
    O = lst[3]
    O = rs.VectorCreate(O,(0,0,0))
    X = rs.VectorUnitize(X)
    Y = rs.VectorUnitize(Y)
    Z = rs.VectorUnitize(Z)
    #Z = rs.VectorCrossProduct(X,Y)
    #Y = rs.VectorCrossProduct(Z,X)
    O = rs.AddPoint(O[0],O[1],O[2])
    pln = rs.PlaneFromFrame(O,X,Y)
    P.append(pln)
    pose.append([O,X,Y,Z])
    file.close()

pose =raggedListToDataTree(pose)
# ---------- end import ----------
panel_2 = Panel(import.name)
av_col = PythonScript(M=merge)  # -> RGB; inputs M: list
# ---------- av_col: Python ----------
import rhinoscriptsyntax as rs
import math
import Rhino.Geometry as rg
from clr import AddReference as addr
addr("Grasshopper")
from System import Object
from Grasshopper import DataTree
from Grasshopper.Kernel.Data import GH_Path

def dataTreeToList(aTree):
    theList = []
    for i in range(aTree.BranchCount ):
        thisListPart = []
        thisBranch = aTree.Branch(i)
        for j in range(len(thisBranch)):
            thisListPart.append( thisBranch[j] )
        theList.append(thisListPart)
    return theList

def raggedListToDataTree(raggedList):
    rl = raggedList
    result = DataTree[object]()
    for i in range(len(rl)):
        temp = []
        for j in range(len(rl[i])):
            temp.append(rl[i][j])
        #print i, " - ",temp
        path = GH_Path(i)
        result.AddRange(temp, path)
    return result

RGB = []

for mesh in M:
    colors = rs.MeshVertexColors(mesh)
    R = 0
    G = 0
    B = 0
    for col in colors:
        R = R + col.R
        G = G + col.G
        B = B + col.B
    R = R/len(colors)
    G = G/len(colors)
    B = B/len(colors)
    RGB.append((int(R),int(G),int(B)))

RBG = raggedListToDataTree(RGB)
# ---------- end av_col ----------

cluster_2 = Cluster_2(data=import.pose)  # -> E, R_2, number_slider_2, R, R_3
dir = PythonScript(C=merge_2, P=import.P)  # -> C
# ---------- dir: Python ----------
import rhinoscriptsyntax as rs

pt = P.Origin

st = rs.CurveStartPoint(C)
en = rs.CurveEndPoint(C)

dist1 = rs.Distance(pt,st)
dist2 = rs.Distance(pt,en)

if dist1<dist2:
    rs.ReverseCurve(C)
# ---------- end dir ----------

corr_skeleton = PythonScript(skel_2d=dir, mesh=merge, ext=Slider(-2, range=-4..2))  # -> skel_3d, skel_pts, radii, aver_r
# ---------- corr_skeleton: Python ----------
import rhinoscriptsyntax as rs
import Rhino.Geometry as rg

def projectPointToMesh(pt,mesh):
    pt1 = None
    ptX = rs.ProjectPointToMesh(pt,mesh,(0,0,1))
    if ptX!=None and len(ptX)==1: 
        pt1 = ptX[0]
    elif ptX!=None and len(ptX)>1:
        pts_list = []
        for x in ptX: pts_list.append(x)
        pts_list.sort(key=getZ)
        pt1 = pts_list[-1]
    else:
        print "error - no point projection found"
    return pt1

def averagePoint(p1,p2):
    x = 0.5*p1[0]+0.5*p2[0]
    y = 0.5*p1[1]+0.5*p2[1]
    z = 0.5*p1[2]+0.5*p2[2]
    p = rs.AddPoint(x,y,z)
    return p


def getZ(point):
    return point[2]

def polyline_to_curve(pl):
    crv = rg.Polyline.ToNurbsCurve(pl)
    return crv


###

crv = skel_2d

### variables inside

step = 4
lower_z_limit = 1.5


###
skel_pts = []
radii = []


a = []

###
length = rs.CurveLength(crv)
n = int(0.5+length/step)
rs.ExtendCurveLength(crv,0,0,ext)
rs.ExtendCurveLength(crv,0,1,ext)
pts = rs.DivideCurve(crv,n)
new_pts = []
for pt in pts:
    t = rs.CurveClosestPoint(crv,pt)
    tan = rs.CurveTangent(crv,t)
    tan = rs.VectorUnitize(tan)
    pt_up = projectPointToMesh(pt,mesh)
    r = None
    if pt_up!=None:
        p_start = rs.AddPoint(pt[0],pt[1],lower_z_limit)
        p_end = rs.AddPoint(pt_up[0],pt_up[1],pt_up[2]-lower_z_limit)
        line = rs.AddLine(p_start,p_end)
        n = int(rs.Distance(p_start,p_end)/0.2)+1
        zpts = rs.DivideCurve(line,n)
        if zpts!=None and len(zpts)>0:
            R = []
            P = []
            for zpt in zpts:
                pln = rs.PlaneFromNormal(zpt,(0,0,1),tan)
                rect = rs.AddRectangle(pln,2,10)
                rs.MoveObject(rect,-1*tan)
                rect2 = rs.CopyObject(rect,-10*pln.YAxis)
                param = rg.MeshingParameters()
                rect = rg.Mesh.CreateFromPlanarBoundary(rs.coercecurve(rect),param)
                rect2 = rg.Mesh.CreateFromPlanarBoundary(rs.coercecurve(rect2),param)
                crv1 = rs.MeshMeshIntersection(mesh,rect)
                crv2 = rs.MeshMeshIntersection(mesh,rect2)
                if crv1!=None and crv2!=None:
                    crv1 = polyline_to_curve(crv1[0])
                    crv2 = polyline_to_curve(crv2[0])
                    t = rs.CurveClosestPoint(crv1,zpt)
                    pt1 = rs.EvaluateCurve(crv1,t)
                    t = rs.CurveClosestPoint(crv2,zpt)
                    pt2 = rs.EvaluateCurve(crv2,t)
                    r = 0.5*rs.Distance(pt1,pt2)
                    R.append(r)
                    new_pt = rs.CurveMidPoint(rs.AddLine(pt1,pt2))
                    P.append(new_pt)
            R = sorted(R)
            P = [x for _,x in sorted(zip(R,P))]
            if len(R)>0: r = R[-1]
            else: r = 2.2
            if len(P)>0: pt = P[-1]
            else: pt =zpt
        else:
            print "error with zpts"
            a.append(line)
    new_pts.append(pt)
    radii.append(r)

r_sum = 0
count = 0
for r in radii:
    if r!=None:
        r_sum = r_sum+r
        count = count+1
average_r = r_sum/count

for i in range(len(radii)):
    if radii[i] == None:
        radii[i] = average_r

for i in range(len(new_pts)):
    pt = new_pts[i]
    pt_up = projectPointToMesh(pt,mesh)
    if pt_up!=None:
        zpt = rs.AddPoint(0,0,-radii[i])
        pt = rs.PointAdd(zpt,pt_up)
        new_pts[i] = pt

### extend
crv = rs.AddCurve(new_pts)
crv = rs.ExtendCurveLength(crv,0,0,-ext)
crv = rs.ExtendCurveLength(crv,0,1,-ext)
st = rs.CurveStartPoint(crv)
en = rs.CurveEndPoint(crv)
new_pts.append(en)
new_pts.insert(0,st)
radii.append(radii[-1])
radii.insert(0,radii[0])



###
skel_3d = rs.AddCurve(new_pts,3)

skel_pts = new_pts

aver_r = average_r
# ---------- end corr_skeleton ----------

vdisex = VectorDisplayEx(Point=cluster_2.E, Vector=cluster_2.R_2, Colour=ColourSwatch(SwatchColor=RGB(255, 0, 0)), Width=2)
vdisex_2 = VectorDisplayEx(Point=cluster_2.E, Vector=cluster_2.R, Colour=ColourSwatch(SwatchColor=RGB(72, 255, 0)), Width=2)
vdisex_3 = VectorDisplayEx(Point=cluster_2.E, Vector=cluster_2.R_3, Colour=swatch, Width=2)
panel_3 = Panel(import.pose)

# ----
# CONSTRUCT BRANCH
radii_num = Number(simplify(corr_skeleton.radii))
skel_pt = Point(simplify(corr_skeleton.skel_pts))
name_txt = Text(panel_2)
ids = PythonScript(n=name_txt)  # -> simplify(ids)
# ---------- ids: Python ----------
ids = []

for i in range(5):
    ids.append(200+i)
# ---------- end ids ----------
pose_vec = Vector(import.pose)
id_int = Integer(ids)
constr_branch = PythonScript(name=name_txt, points=skel_pt, radii=radii_num, pose=pose_vec, ids=id_int, color=av_col)  # -> branch; inputs name: list, points: tree of Point3d, radii: tree, pose: tree, ids: tree, color: list
# ---------- constr_branch: Python ----------
import rhinoscriptsyntax as rs
import math
import Rhino.Geometry as rg
from clr import AddReference as addr
addr("Grasshopper")
from System import Object
from Grasshopper import DataTree
from Grasshopper.Kernel.Data import GH_Path

def dataTreeToList(aTree):
    theList = []
    for i in range(aTree.BranchCount ):
        thisListPart = []
        thisBranch = aTree.Branch(i)
        for j in range(len(thisBranch)):
            thisListPart.append( thisBranch[j] )
        theList.append(thisListPart)
    return theList

def raggedListToDataTree(raggedList):
    rl = raggedList
    result = DataTree[object]()
    for i in range(len(rl)):
        temp = []
        for j in range(len(rl[i])):
            temp.append(rl[i][j])
        #print i, " - ",temp
        path = GH_Path(i)
        result.AddRange(temp, path)
    return result

def list_to_string(lst):
    txt = ''
    for k in range(len(lst)):
        txt = txt+str(lst[k])
        if k<len(lst)-1: txt = txt+','        
    return txt

points = dataTreeToList(points)
radii = dataTreeToList(radii)
pose = dataTreeToList(pose)
ids = dataTreeToList(ids)

branch = []

for i in range(len(name)):
    n = name[i]
    p = points[i]
    crv = rs.AddCurve(p)
    r = list_to_string(radii[i])
    pose_pts = []
    org = pose[i][0]
    org = rs.AddPoint(org[0],org[1],org[2])
    pose_pts.append(org)
    for j in range(1,len(pose[i])):
        pt2 = rs.AddPoint(pose[i][j][0],pose[i][j][1],pose[i][j][2])
        pt = rs.PointAdd(org,pt2)
        pose_pts.append(pt)
    po = rs.AddPolyline(pose_pts)
    #po = pose[i]
    id = list_to_string(ids[i])
    c = color[i]
    branch.append([n,crv,r,po,id,c])

branch = raggedListToDataTree(branch)
# ---------- end constr_branch ----------
branch_data = Data(constr_branch)

# ----
# DISPLAY BRANCH
branch_data_2 = Data(constr_branch)
geometry = PythonScript(branch=branch_data_2)  # -> G, M, C; inputs branch: tree
# ---------- geometry: Python ----------
import rhinoscriptsyntax as rs
import math
import Rhino.Geometry as rg
from clr import AddReference as addr
addr("Grasshopper")
from System import Object
from Grasshopper import DataTree
from Grasshopper.Kernel.Data import GH_Path

def dataTreeToList(aTree):
    theList = []
    for i in range(aTree.BranchCount ):
        thisListPart = []
        thisBranch = aTree.Branch(i)
        for j in range(len(thisBranch)):
            thisListPart.append( thisBranch[j] )
        theList.append(thisListPart)
    return theList

def raggedListToDataTree(raggedList):
    rl = raggedList
    result = DataTree[object]()
    for i in range(len(rl)):
        temp = []
        for j in range(len(rl[i])):
            temp.append(rl[i][j])
        #print i, " - ",temp
        path = GH_Path(i)
        result.AddRange(temp, path)
    return result

def string_to_list(txt):
    lst = txt.split(',')
    for k in range(len(lst)):
        lst[k] = float(lst[k])
    return lst

branch = dataTreeToList(branch)
#[name(0),points(1),radii(2),pose(3),ids(4),color(5)]

G = []
M = []
M_col = []
C = []

for br in branch:
    if br == None: continue 
    crv = br[1]
    pts = rs.CurvePoints(crv)
    pts = rs.DivideCurve(crv,len(pts)-1)
    rad = string_to_list(br[2])
    #
    profiles = []
    #
    for i in range(len(pts)):
        pt = pts[i]
        r = rad[i]
        t = rs.CurveClosestPoint(crv,pt)
        #if i == len(pts)-1: t = rs.CurveClosestPoint(crv,pts[i-1])
        tan = rs.CurveTangent(crv,t)
        X = rs.VectorCrossProduct((0,0,1),tan)
        pln = rs.PlaneFromNormal(pt,tan,X)
        circle = rs.AddCircle(pln,r)
        profiles.append(circle)
    geo = rs.AddLoftSrf(profiles)[0]
    rs.CapPlanarHoles(geo)
    mesh = rg.Mesh.CreateFromBrep(rs.coercebrep(geo))
    mesh = rs.JoinMeshes(mesh)
    #param = rg.MeshingParameters()
    #E = rg.Mesh.CreateFromPlanarBoundary(rs.coercecurve(start),param)
    colors = []
    color = br[5]
    for i in range(rs.MeshVertexCount(mesh)):
        colors.append(color)
    rs.MeshVertexColors(mesh,colors)
    #
    G.append(geo)
    M.append(mesh)
    ## cube
    d = 4.7
    e = 0.6 
    ## pose plane
    pose_pl = br[3]
    pose_pts = rs.CurvePoints(pose_pl)
    org = pose_pts[0]
    X = rs.VectorCreate(pose_pts[1],pose_pts[0])
    Y = rs.VectorCreate(pose_pts[2],pose_pts[0])
    Z = rs.VectorCreate(pose_pts[3],pose_pts[0]) 
    ### adjust org considering boarder
    org = rs.VectorAdd(org,-e*X)
    org = rs.VectorAdd(org,-e*Y)
    org = rs.AddPoint(org[0],org[1],org[2])
    ## plane
    pln = rs.PlaneFromFrame(org,X,Y)
    ##
    R = rs.AddRectangle(pln,d,d)
    ptz = d*pln.ZAxis
    ptz = rs.AddPoint(ptz[0],ptz[1],ptz[2])
    path = rs.AddLine((0,0,0),ptz)
    B = rs.ExtrudeCurve(R,path)
    rs.CapPlanarHoles(B)
    C.append(B)
# ---------- end geometry ----------
pose = PythonScript(branch=branch_data_2)  # -> A, V; inputs branch: tree
# ---------- pose: Python ----------
import rhinoscriptsyntax as rs
import Rhino as rc
import math
import Rhino.Geometry as rg
from clr import AddReference as addr
addr("Grasshopper")
from System import Object
from Grasshopper import DataTree
from Grasshopper.Kernel.Data import GH_Path

def dataTreeToList(aTree):
    theList = []
    for i in range(aTree.BranchCount ):
        thisListPart = []
        thisBranch = aTree.Branch(i)
        for j in range(len(thisBranch)):
            thisListPart.append( thisBranch[j] )
        theList.append(thisListPart)
    return theList

def raggedListToDataTree(raggedList):
    rl = raggedList
    result = DataTree[object]()
    for i in range(len(rl)):
        temp = []
        for j in range(len(rl[i])):
            temp.append(rl[i][j])
        #print i, " - ",temp
        path = GH_Path(i)
        result.AddRange(temp, path)
    return result

branch = dataTreeToList(branch)

A = []
V = []

for br in branch:
    pose_pl = br[3]
    pose_pts = rs.CurvePoints(pose_pl)
    for i in range(1,len(pose_pts)):
        vec = 5*rs.VectorCreate(pose_pts[i],pose_pts[0])
        A.append(pose_pts[0])
        V.append(vec)
# ---------- end pose ----------
mesh = Mesh(geometry.M)
vdis = VectorDisplay(Anchor=pose.A, Vector=pose.V)
brep_2 = Brep([geometry.C, geometry.G])

# ----
# ORGANIZE BRANCHES
planes = PythonScript(B=constr_branch)  # -> REF, TAR; inputs B: tree
# ---------- planes: Python ----------
import rhinoscriptsyntax as rs
import math
import Rhino.Geometry as rg
from clr import AddReference as addr
addr("Grasshopper")
from System import Object
from Grasshopper import DataTree
from Grasshopper.Kernel.Data import GH_Path

def dataTreeToList(aTree):
    theList = []
    for i in range(aTree.BranchCount ):
        thisListPart = []
        thisBranch = aTree.Branch(i)
        for j in range(len(thisBranch)):
            thisListPart.append( thisBranch[j] )
        theList.append(thisListPart)
    return theList

def raggedListToDataTree(raggedList):
    rl = raggedList
    result = DataTree[object]()
    for i in range(len(rl)):
        temp = []
        for j in range(len(rl[i])):
            temp.append(rl[i][j])
        #print i, " - ",temp
        path = GH_Path(i)
        result.AddRange(temp, path)
    return result

B = dataTreeToList(B)
#[name(0),skel_crv(1),radii(2),pose(3),ids(4),color(5)]

x_space = 10

REF = []
TAR = []

for i in range(len(B)):
    # target
    tar_pln = rs.PlaneFromFrame((x_space*i,0,0),(1,0,0),(0,1,0))
    TAR.append(tar_pln)
    # reference
    crv = B[i][1]
    mid = rs.CurveMidPoint(crv)
    t = rs.CurveClosestPoint(crv,mid)
    tan = rs.CurveTangent(crv,t)
    Y = tan
    X = rs.VectorCrossProduct(Y,(0,0,1))
    ref = rs.PlaneFromFrame(mid,X,Y)
    REF.append(ref)
# ---------- end planes ----------
orient = PythonScript(branch=constr_branch, REF=planes.REF, TAR=planes.TAR)  # -> branch; inputs branch: tree, REF: list, TAR: list
# ---------- orient: Python ----------
import rhinoscriptsyntax as rs
import math
import Rhino.Geometry as rg
from clr import AddReference as addr
addr("Grasshopper")
from System import Object
from Grasshopper import DataTree
from Grasshopper.Kernel.Data import GH_Path

def dataTreeToList(aTree):
    theList = []
    for i in range(aTree.BranchCount ):
        thisListPart = []
        thisBranch = aTree.Branch(i)
        for j in range(len(thisBranch)):
            thisListPart.append( thisBranch[j] )
        theList.append(thisListPart)
    return theList

def raggedListToDataTree(raggedList):
    rl = raggedList
    result = DataTree[object]()
    for i in range(len(rl)):
        temp = []
        for j in range(len(rl[i])):
            temp.append(rl[i][j])
        #print i, " - ",temp
        path = GH_Path(i)
        result.AddRange(temp, path)
    return result

def plane_points(pln):
    org = pln.Origin
    X = pln.XAxis
    Y = pln.YAxis
    pts = (org,org+X,org+Y)
    return pts

def vec_from_line(ln):
    st = rs.CurveStartPoint(ln)
    en = rs.CurveEndPoint(ln)
    vec = rs.VectorCreate(en,st)
    return vec

def pnt(v):
    pt = rs.AddPoint(v[0],v[1],v[2])
    return pt

branch = dataTreeToList(branch)
#[name(0),points(1),radii(2),pose(3),ids(4),color(5)]
#skeleton points and pose needs to be updated, the rest stays the same!

for i in range(len(branch)):
    crv = branch[i][1]
    pose_pl = branch[i][3]
    tar = TAR[i]
    ref = REF[i]
    #
    tar_pts = plane_points(tar)
    ref_pts = plane_points(ref)
    #
    rs.OrientObject(crv,ref_pts,tar_pts)
    #
    rs.OrientObject(pose_pl,ref_pts,tar_pts)
    #
    branch[i][1] = crv
    branch[i][3] = pose_pl

branch = raggedListToDataTree(branch)
# ---------- end orient ----------

item_2 = ListItem(List=geometry.G, Index=number_slider_6, Wrap=True)
item_3 = ListItem(List=geometry.C, Index=number_slider_6, Wrap=True)
# MATCH
match = PythonScript(IDEAL=item, XPTS=python, BRANCH=branch_data)  # -> a, REPOS_REAL, UNTRIMMED, DIFF; inputs IDEAL: list, XPTS: tree of Point3d, BRANCH: tree
# ---------- match: Python ----------
import rhinoscriptsyntax as rs
import Rhino.Geometry as rg
from clr import AddReference as addr
addr("Grasshopper")
from System import Object
from Grasshopper import DataTree
from Grasshopper.Kernel.Data import GH_Path

def dataTreeToList(aTree):
    theList = []
    for i in range(aTree.BranchCount ):
        thisListPart = []
        thisBranch = aTree.Branch(i)
        for j in range(len(thisBranch)):
            thisListPart.append( thisBranch[j] )
        theList.append(thisListPart)
    return theList

def raggedListToDataTree(raggedList):
    rl = raggedList
    result = DataTree[object]()
    for i in range(len(rl)):
        temp = []
        for j in range(len(rl[i])):
            temp.append(rl[i][j])
        #print i, " - ",temp
        path = GH_Path(i)
        result.AddRange(temp, path)
    return result

def plane_points(pln):
    org = pln.Origin
    X = pln.XAxis
    Y = pln.YAxis
    pts = (org,org+X,org+Y)
    return pts

def get_norm_params_relative_midpoint(crv,pts):
    # Returns the normalized parameters of a list of points on a curve,
    # relative to the mid point of the curve
    T = []
    ref_pt = rs.CurveMidPoint(crv)
    t_ref = rs.CurveClosestPoint(crv,ref_pt)
    t_ref = rs.CurveNormalizedParameter(crv,t_ref)
    for pt in pts:
        t = rs.CurveClosestPoint(crv,pt)
        t = rs.CurveNormalizedParameter(crv,t)
        t = t - t_ref
        T.append(t)
    return(T)

def get_points_from_norm_params_relative_ref_point(crv,norm_rel_T,ref_pt):
    # Return the points on a curve, defined by a list of normalized parameters
    # and relative to a reference point
    pts = []
    t_ref = rs.CurveClosestPoint(crv,ref_pt)
    t_ref = rs.CurveNormalizedParameter(crv,t_ref)
    for norm_t in norm_rel_T:
        t = rs.CurveParameter(crv,norm_t+t_ref)
        pt = rs.EvaluateCurve(crv,t)
        pts.append(pt)
    return pts

def  get_curve_ref_parameters(crv,target_len,interval):
    ref_T = []
    length = rs.CurveLength(crv)
    len_diff = length-target_len
    n = int(0.5+len_diff/interval)
    if n>0:
        st = rs.DivideCurveLength(crv,0.5*target_len)[1]
        st_t = rs.CurveClosestPoint(crv,st)
        en = rs.DivideCurveLength(crv,0.5*target_len+len_diff)[1]
        en_t = rs.CurveClosestPoint(crv,en)
        step = (en_t-st_t)/n
        for i in range(n+1):
            t = st_t+step*i
            ref_T.append(t)
    else:
        pt = rs.CurveMidPoint(crv)
        t = rs.CurveClosestPoint(crv,pt)
        ref_T.append(t)
    return ref_T

def orient_real_to_ideal(crv_, target_rel_ts2, target_pln, ref_t, ref_axis):
    crv = rs.CopyObject(crv_)
    # a) Get corresponding pts2 on curve
    ref_pt = rs.EvaluateCurve(crv,ref_t)
    pts2 = get_points_from_norm_params_relative_ref_point(crv,target_rel_ts2,ref_pt)
    dir = rs.VectorCreate(pts2[1],pts2[0])
    ctr = 0.5*rs.PointAdd(pts2[1],pts2[0])
    # b) Orient by reference plane (segment) and target plane (ideal)
    ref_pln = rs.PlaneFromNormal(ctr,ref_axis,dir)
    rs.OrientObject(crv,plane_points(ref_pln),plane_points(pln_ideal))
    return crv

def curve_difference_lite(real,ideal,xpts):
    diff_joint_dist = curve_joint_dist_difference(real,ideal,xpts)
    diff = round(diff_joint_dist,3)
    return diff

def curve_joint_dist_difference(crv1,crv2,pts2):
    sum = 0
    for pt2 in pts2:
        t = rs.CurveClosestPoint(crv1,pt2)
        pt1 = rs.EvaluateCurve(crv1,t)
        dist = rs.Distance(pt1,pt2)
        sum = sum+dist
    average_diff = sum/len(pts2)
    return average_diff

def get_diffs(crvs,ideal,xpts):
    diffs = []
    for crv in crvs:
        diff = curve_difference_lite(crv,ideal,xpts)
        diffs.append(diff)
    return diffs

def trim_curve(crv_,ref_crv):
    crv = rs.CopyObject(crv_)
    st = rs.CurveStartPoint(ref_crv)
    st_t = rs.CurveClosestPoint(crv,st)
    en = rs.CurveEndPoint(ref_crv)
    en_t = rs.CurveClosestPoint(crv,en)
    crv = rs.TrimCurve(crv,(st_t,en_t))
    return crv

def get_refined_reference_parameters(crv,ref_t,dist,step):
    T = []
    n = int(0.5+0.5*(dist/step))
    st = rs.CurveStartPoint(crv)
    st_t = rs.CurveClosestPoint(crv,st)
    en = rs.CurveEndPoint(crv)
    en_t = rs.CurveClosestPoint(crv,en)
    t_range = en_t-st_t
    length = rs.CurveLength(crv)
    factor = t_range/length
    for i in range(-n,n):
        if n==0: T.append(ref_t)
        else:
            t = ref_t-step*factor*i
            T.append(t)
    return T

def get_average_point(pts):
    x = 0
    y = 0
    z = 0
    for pt in pts:
        x =+ pt[0]
        y =+ pt[1]
        z =+ pt[2]
    x = x/len(pts)
    y = y/len(pts)
    z = z/len(pts)
    pt = rs.AddPoint(x,y,z)
    return pt

def get_average_direction(pts):
    V = rs.VectorCreate((0,0,0),(0,0,0))
    for i in range(len(pts)):
        for j in range(len(pts)):
            if j<=i: continue
            vec = rs.VectorCreate(pts[j],pts[i])
            V = rs.VectorAdd(V,vec)
    V = rs.VectorUnitize(V)
    return V

def get_plane_fit_to_curve(crv,n):
    pts = rs.DivideCurve(crv,n)
    pln = rs.PlaneFitFromPoints(pts)
    return pln

XPTS = dataTreeToList(XPTS)
BRANCH = dataTreeToList(BRANCH)

REAL = []
for branch in BRANCH: REAL.append(branch[1])

### Initialize output lists
REPOS_REAL = []
UNTRIMMED = []
DIFF = []

# test list
a = []

for i in range(len(IDEAL)):
    #
    ### Extract values for ideal curve
    #
    ideal = IDEAL[i]
    xpts = XPTS[i]
    #
    ### Calculate properties of ideal curve
    #
    dir_ideal = get_average_direction(xpts)
    ctr_ideal = get_average_point(xpts)
    pln_strong_ideal = get_plane_fit_to_curve(ideal,10)
    pln_Y = rs.VectorCrossProduct(dir_ideal,pln_strong_ideal.Normal)
    pln_ideal = rs.PlaneFromFrame(ctr_ideal,dir_ideal,pln_Y)
    tsx_ideal = get_norm_params_relative_midpoint(ideal,xpts)
    length_ideal = rs.CurveLength(ideal)
    #
    ### Initiate local lists to store each real branch at its best fitting pose
    ### and its difference to the ideal curve
    #
    repos_real = []
    diff_total = []
    untrimmed = []
    #
    ### Iterate all the real curves
    #
    for j in range(len(REAL)):
        real = rs.CopyObject(REAL[j])
        #
        ### Obmit real curve if it is shorter than the ideal one
        #
        length = rs.CurveLength(real)
        if length < length_ideal: 
            repos_real.append(None)
            diff_total.append(99)
            untrimmed.append(None)
            continue
        #
        ### Try  matching the real branch at different poses
        #
        ### First along length
        ### Create a series of "midpoints" at every about every 5 cm
        #
        temp_reals = []
        ref_T = get_curve_ref_parameters(real,length_ideal,5)
        for ref_t in ref_T:
            #
            ### Make 4 real position posibilities
            #
            ref_pt = rs.EvaluateCurve(real,ref_t)
            xpts_real = get_points_from_norm_params_relative_ref_point(real,tsx_ideal,ref_pt)
            # get dir
            # get same for reversed curve
            # get strongest plane for the segment
            # get reference plane Y axes buy normxdir and dirxnorm
            # make 4 planes
            # browse planes and orient in the 4 poses (store which pose (0,1,2 or 3)
            # add oriented branch to list
#        diffs = get_diffs(temp_reals,ideal,xpts)
#        diff = sorted(diffs)[0]
#        real = [x for _,x in sorted(zip(diffs,temp_reals))][0]
#        post = [x for _,x in sorted(zip(diffs,temp_pos_t))][0]
#        #if i == 11: a.extend(temp_reals)
#        #
#        ### d) Refine at every 1 cm
#        #
#        ref_T = get_refined_reference_parameters(real,post,6,1)
#        temp_reals = []
#        for ref_t in ref_T:
#            real_ = orient_real_to_ideal(real, ts2_ideal, pln_ideal, ref_t, norm_ideal)
#            temp_reals.append(real_)
#        diffs = get_diffs(temp_reals,ideal,xpts,xnorms)
#        diff = sorted(diffs)[0]
#        real = [x for _,x in sorted(zip(diffs,temp_reals))][0]
#        #
#        # Append final lists
#        #
#        untrimmed.append(real)
#        real = trim_curve(real,ideal)
#        repos_real.append(real)
#        diff_total.append(diff)
#    REPOS_REAL.append(repos_real)
#    UNTRIMMED.append(untrimmed)
#    DIFF.append(diff_total)

#REPOS_REAL = raggedListToDataTree(REPOS_REAL)
#UNTRIMMED = raggedListToDataTree(UNTRIMMED)
#DIFF = raggedListToDataTree(DIFF)
# ---------- end match ----------
assign = PythonScript(DIFF_TOTAL=match.DIFF)  # -> indices; inputs DIFF_TOTAL: tree; disabled
# ---------- assign: Python ----------
import rhinoscriptsyntax as rs
import Rhino.Geometry as rg
import rhinoscriptsyntax as rs
import Rhino.Geometry as rg
from clr import AddReference as addr
addr("Grasshopper")
from System import Object
from Grasshopper import DataTree
from Grasshopper.Kernel.Data import GH_Path


def get_maximum_assignements(list):
    ind = [None] * len(list)          # Create an initial list of "Nons"
    for i in range(len(list)):        # Browse list of possible column matches (list_of_zeros)
        for j in range(len(list[i])): # Brows possible column matches for each row
            item = list[i][j]
            if already_exists(ind,item)==False: # Check if item already exists in list if assigned column indexes
                ind[i] = item                   # If it doesnt, assign this posibility to the row
                break                           # And break
        if ind[i] == None:                  # If no match was found yet for this row
            for j in range(len(list[i])):   # Browse possibilities again
                item = list[i][j]           
                (ind,free) = try_reassigning(ind,[item],list,0) # Try to geassign the possibility where it already exists in the list
                if free == True:            # If reassignment was successfull, 
                    ind[i] = item           # assign possibility to the current row
                    break                   # and break
    return ind  # return list of assigned columns

def try_reassigning(ass_list,visited_col_indexes,poss_list,n): 
    if n>len(ass_list):                     # If n is higher than "safetly limit" for recusion function, 
        print "Ended early"     # 
        return (ass_list,False) # return that reassignment was unsuccessful (false)
    else:
        col_index = visited_col_indexes[-1]               # The index we are looking at currently is the last one added to the list of visited indexes
        other_row = get_index_in_list(ass_list,col_index) # Find the row of the column index you are trying to free up
        other_row_poss_list = poss_list[other_row]        # Get the list of possibilities for this row
        if len(other_row_poss_list)<=1:                   # If the possibilities are just one, it is impossible to reassign
            #print "Ended because ran into list of just one possibility"   
            return (ass_list,False)                       # return that reassignment was unsuccessful (false)
        else:           # Else we have a list of several possibilities, so we can try other ones
            n = n+1     # Add value to your safety number, so that you wont go in endless loops
            success = False
            for poss in other_row_poss_list:             # The possibilities for this row
                if poss==col_index: continue             # If it is same as the one already assigned, move on immediately
                if already_exists(ass_list,poss)==False: # Check if the possibility already exists elsewhere among assignments
                    ass_list[other_row] = poss           # If not, reassign!
                    #print "Reassignment success!!!!!!!!!!!!!!!!!!!!!!!!!!!!!!!!!!!!!!!!!!!!!!!!!!!!!!!!!!!"
                    success = True                       # Recoded that reassignemnt was successful
                    break                                # And exit loop
            if success == False:                                    # If reassignment still wasn't successful...
                for poss in other_row_poss_list:                    # Browse the possibilities again
                    if poss==col_index: continue                    # If it is same as the one already assigned, move on immediately               
                    #print "***Doing a recursion***"                 # Do a recusstion, trying to reassign the value to freeup the one you are trying to reassign
                    if already_exists(visited_col_indexes,poss)==False: # Avoid looping in recursion
                        visited_col_indexes.append(poss)
                        (ass_list,success) = try_reassigning(ass_list,visited_col_indexes,poss_list,n)
                        if success == True:                             # If this reassignment is successful
                            #print "***Did a successful recursion***"          
                            ass_list[other_row] = poss                  # Assign the new possibility to the other row 
                            break                                       # Exit loop
                    #else: 
                    #    print "Didnt continue recursion because of loop"
            return (ass_list,success)                               # Return (possibly) updated assignment list and weather or not the operation was successful

def dataTreeToList(aTree):
    theList = []
    for i in range(aTree.BranchCount ):
        thisListPart = []
        thisBranch = aTree.Branch(i)
        for j in range(len(thisBranch)):
            thisListPart.append( thisBranch[j] )
        theList.append(thisListPart)
    return theList

def get_list_of_all_zeros(matrix):
    zeros = [None] * len(matrix)
    for i in range(len(matrix)):
        row_zeros = []
        for j in range(len(matrix[i])):
            if matrix[i][j]==0.00:
                row_zeros.append(j)
        zeros[i] = row_zeros
    return zeros

def get_unssigned_rows(list):
    non_items = []
    for i in range(len(list)):
        if list[i]==None:
            non_items.append(i)
    return non_items

def invert_mark(list,list_length):
    unmarked = []
    for i in range(list_length):
        marked = False
        for mark in list:
            if i==mark:
                marked = True
                break
        if marked == False:
            unmarked.append(i)
    return unmarked

def already_exists(list,item):
    exists = False
    for item2 in list:
        if item == item2:
            exists = True
            break
    return exists

def get_index_in_list(list,value):
    index = None
    for i in range(len(list)):
        if list[i]==value: index = i
    return index

def make_square(matrix):
    row_no = len(matrix)
    col_no = len(matrix[0])
    # Add rows if number of columns is greater than number of rows
    if row_no<col_no:
        zero_row = []
        add_no = col_no-row_no
        for i in range(col_no): zero_row.append(0)
        for i in range(add_no): matrix.append(zero_row)
    # Make matrix square by adding dummy zeros
    # Add columns if number of columns is smaller than number of rows
    if row_no>col_no:
        zero_col = []
        add_no = row_no-col_no
        for i in range(len(matrix)):
            for j in range(add_no): 
                matrix[i].append(0)
    return matrix

mat = dataTreeToList(DIFF_TOTAL)

# Make matrix square by adding dummy zeros
# Store original size in order to revert to it at the end
org_row_no = len(mat)
org_col_no = len(mat[0])
mat = make_square(mat)
print "Size",len(mat),len(mat[0])

### Make integer (for faster calculation) ###
for i in range(len(mat)):
    for j in range(len(mat[i])):
        mat[i][j] = int(10*mat[i][j]+0.5)
#print "Start matrix", mat

### Subtract minimum value in each row (should result in at least one 0 in each row) ###
for i in range(len(mat)):
    min_value = sorted(mat[i])[0]
    for j in range(len(mat[i])): mat[i][j] = mat[i][j]-min_value

### Subtract minimum value in each col (should result in at least one 0 in each col) ###
for j in range(len(mat[0])):
    temp = []
    for i in range(len(mat)):
        temp.append(mat[i][j])
    min_value = sorted(temp)[0]
    if min_value==0: continue
    for i in range(len(mat)):
        mat[i][j] = mat[i][j]-min_value
#print "Matrix after initial subtractions", mat

for iterantion0 in range(len(mat)*len(mat[0])):
    print " - - - - - - - - - - I T E R A T I O N   ",iterantion0,"    - - - - - - - - - - "
    #
    ### Try to assign one column to each row ###
    #
    zeros_list = get_list_of_all_zeros(mat)
    #print "Zeros", zeros_list
    indices = get_maximum_assignements(zeros_list)
    print "Indices:",indices
    unass = get_unssigned_rows(indices)
    # 
    ### Break if there are no unassigned columns ###
    #
    if len(unass)==0:
        print "Done!"
        break
    ### Mark rows and columns ###
    #
    #1. Tick all unassigned rows
    #
    marked_rows = unass
    marked_columns = []
    for mark_iteration in range(len(mat)):
        #
        # 2. Tick all (unticked) columns that have zeros in ticked rows
        #
        start_len_cols = len(marked_columns)
        for row_index in marked_rows:
            #find zeros in this row
            for j in range(len(mat[0])):
                if mat[row_index][j]==0:
                    # Check that it is not already added to marked columns
                    new = True
                    for mark in marked_columns:
                        if mark==j:
                            new = False
                            break
                    if new == True: marked_columns.append(j)
        marked_columns = sorted(marked_columns)
        #print "Marked cols at",mark_iteration,"are",marked_columns
        #
        # 3. Tick all (unticked) rows that have assigned zeros in ticked columns
        #
        start_len_rows = len(marked_rows)
        for col_index in marked_columns:
            # Find zeros in the column
            for i in range(len(indices)):
                index = indices[i]
                if col_index == index:
                    new = True
                    for mark in marked_rows:
                        if mark == i:
                            new = False
                            break
                    if new==True: marked_rows.append(i)
        marked_rows = sorted(marked_rows)
        #print "Marked rows at",mark_iteration,"are",marked_rows
        # Break if no items were added to columns or rows at this iteration
        if start_len_rows==len(marked_rows) and start_len_cols==len(marked_columns):
            print "Marking done at iteration:", mark_iteration
            break
    marked_rows = invert_mark(marked_rows,len(mat))
    print "Marked rows", marked_rows
    print "Marked colmuns", marked_columns
    #
    ### Find the smallest value in unmarked columns and unmarked rows ###
    #
    unmarked_items = []
    for i in range(len(mat)):
        marked = False
        for mark in marked_rows:
            if i == mark:
                marked = True
                break
        if marked == True: continue
        for j in range(len(mat[i])):
            marked = False
            for mark in marked_columns:
                if j == mark:
                    marked = True
                    break
            if marked == True: continue
            unmarked_items.append(mat[i][j])
    if len(unmarked_items)==0: 
        print "***Break because all items are marked"
        break
    lowest_value = min(unmarked_items)
    print "Lowest value:", lowest_value
    if lowest_value == 0: 
        print "****Break because lowest_value was zero"
        break
    #
    ### Subtract the lowest value from all unmarked elements ###
    ### and add it to all double-marked elements             ###
    #
    for i in range(len(mat)):
        #check for marked row
        marked_row = False
        for mark in marked_rows:
            if i == mark:
                marked_row = True
        for j in range(len(mat[i])):
            marked_col = False
            for mark in marked_columns:
                if j == mark:
                    marked_col = True
            if marked_row==False and marked_col==False:
                mat[i][j] = mat[i][j]-lowest_value
            elif marked_row==True and marked_col==True:
                mat[i][j] = mat[i][j]+lowest_value
    #print "New mat",mat


### Remove padded part of matrix ###
#
# 1. Remove rows if number of initial rows were smaller
#
if org_row_no<len(mat):
    for i in range(len(mat)-org_row_no):
        indices.pop()
#
# Or 2. Remove columns if number of initial columns was smaller
#
if org_col_no<len(mat[0]):
    for i in range(len(indices)):
        if indices[i]>=org_col_no:
            indices[i]=None

#Finally print result!
print "Result:",indices
# ---------- end assign ----------
# RELAX
pick = PythonScript(REPOS_REAL=match.REPOS_REAL, UNTRIMMED=match.UNTRIMMED, DIFF=match.DIFF, indices=assign)  # -> REPOS_REAL_sel, UNTRIMMED_sel, DIFF_sel, REAL_sel, REAL_leftover; inputs REPOS_REAL: tree, UNTRIMMED: tree, DIFF: tree, REAL: tree, indices: list; disabled
# ---------- pick: Python ----------
import rhinoscriptsyntax as rs
import Rhino.Geometry as rg
from clr import AddReference as addr
addr("Grasshopper")
from System import Object
from Grasshopper import DataTree
from Grasshopper.Kernel.Data import GH_Path

def dataTreeToList(aTree):
    theList = []
    for i in range(aTree.BranchCount ):
        thisListPart = []
        thisBranch = aTree.Branch(i)
        for j in range(len(thisBranch)):
            thisListPart.append( thisBranch[j] )
        theList.append(thisListPart)
    return theList

def raggedListToDataTree(raggedList):
    rl = raggedList
    result = DataTree[object]()
    for i in range(len(rl)):
        temp = []
        for j in range(len(rl[i])):
            temp.append(rl[i][j])
        #print i, " - ",temp
        path = GH_Path(i)
        result.AddRange(temp, path)
    return result

REPOS_REAL = dataTreeToList(REPOS_REAL)
UNTRIMMED = dataTreeToList(UNTRIMMED)
REAL = dataTreeToList(REAL)
DIFF = dataTreeToList(DIFF)

REPOS_REAL_sel = []
UNTRIMMED_sel = []
DIFF_sel = []
REAL_sel = []
REAL_leftover = []

for repos_reals,untrimmed,diff,index in zip(REPOS_REAL,UNTRIMMED,DIFF,indices):
    if index == None:
        REPOS_REAL_sel.append(None)
        UNTRIMMED_sel.append(None)
        REAL_sel.append(None)
        DIFF_sel.append(None)
    else:
        REPOS_REAL_sel.append(repos_reals[index])
        UNTRIMMED_sel.append(untrimmed[index])
        REAL_sel.append(REAL[index])
        DIFF_sel.append(diff[index])

for i in range(len(REAL)):
    if i not in indices:
        REAL_leftover.append(REAL[i])


REAL_sel = raggedListToDataTree(REAL_sel)
REAL_leftover = raggedListToDataTree(REAL_leftover)
# ---------- end pick ----------

# ----
# PICK
button = Button()
import_2 = PythonScript(path=panel, refresh=button)  # -> ang, branch_name, joint_index, pln_jnt, pln_mrk, pln, X, Y, Z
# ---------- import_2: Python ----------
import rhinoscriptsyntax as rs

location = str(path)+'\\2_fab_pose.txt'
file = open(location,'r')
lst = file.readlines()

# get branch name and joint index
branch_name = lst[0].split(',')[0]
joint_index = lst[0].split(',')[1]
joint_index = int(joint_index)-1
lst.pop(0)
for i in range(len(lst)):
    lst[i] = lst[i].split(',')
    lst[i].pop()
    if len(lst[i])>3: lst[i].pop()
    for j in range(len(lst[i])):
        lst[i][j] = float(lst[i][j])

X = rs.VectorCreate(lst[0],(0,0,0))
Y = rs.VectorCreate(lst[1],(0,0,0))
Z = rs.VectorCreate(lst[2],(0,0,0))
O = lst[3]
pln = rs.PlaneFromFrame(O,X,Y)
ang = rs.VectorAngle(Z,pln.Normal)
print ang
file.close()

if joint_index >=0:
    pln_jnt = pln
    pln_mrk = None
else:
    joint_index = None
    pln_jnt = None
    pln_mrk = pln
# ---------- end import_2 ----------

panel_4 = Panel(import_2.ang)
pln = Plane(import_2.pln)

# ----
# JOINT POINTS
planes_2 = PythonScript(C=crv, branch=branch_data)  # -> REF, TAR; inputs C: list, branch: tree
# ---------- planes_2: Python ----------
import rhinoscriptsyntax as rs
import Rhino.Geometry as rg
from clr import AddReference as addr
addr("Grasshopper")
from System import Object
from Grasshopper import DataTree
from Grasshopper.Kernel.Data import GH_Path

def dataTreeToList(aTree):
    theList = []
    for i in range(aTree.BranchCount ):
        thisListPart = []
        thisBranch = aTree.Branch(i)
        for j in range(len(thisBranch)):
            thisListPart.append( thisBranch[j] )
        theList.append(thisListPart)
    return theList

def raggedListToDataTree(raggedList):
    rl = raggedList
    result = DataTree[object]()
    for i in range(len(rl)):
        temp = []
        for j in range(len(rl[i])):
            temp.append(rl[i][j])
        #print i, " - ",temp
        path = GH_Path(i)
        result.AddRange(temp, path)
    return result

branch = dataTreeToList(branch)
#[name(0),points(1),radii(2),pose(3),ids(4),color(5)]

REF = []
TAR = []

for crv,br in zip(C,branch):
    original = br[1]
    #
    tar_pts = rs.DivideCurve(crv,5)
    tar_pln = rs.PlaneFromPoints(tar_pts[0],tar_pts[2],tar_pts[-1])
    ref_pts = rs.DivideCurve(original,5)
    ref_pln = rs.PlaneFromPoints(ref_pts[0],ref_pts[2],ref_pts[-1])
    #
    REF.append(ref_pln)
    TAR.append(tar_pln)
# ---------- end planes_2 ----------

# ----
# DISPLAY BRANCH
orient_2 = PythonScript(branch=branch_data, REF=planes_2.REF, TAR=planes_2.TAR)  # -> branch; inputs branch: tree, REF: list, TAR: list; same code as orient
pose_2 = PythonScript(branch=orient_2)  # -> O, X, Y, Z; inputs branch: tree
# ---------- pose_2: Python ----------
import rhinoscriptsyntax as rs
import Rhino as rc
import math
import Rhino.Geometry as rg
from clr import AddReference as addr
addr("Grasshopper")
from System import Object
from Grasshopper import DataTree
from Grasshopper.Kernel.Data import GH_Path

def dataTreeToList(aTree):
    theList = []
    for i in range(aTree.BranchCount ):
        thisListPart = []
        thisBranch = aTree.Branch(i)
        for j in range(len(thisBranch)):
            thisListPart.append( thisBranch[j] )
        theList.append(thisListPart)
    return theList

def raggedListToDataTree(raggedList):
    rl = raggedList
    result = DataTree[object]()
    for i in range(len(rl)):
        temp = []
        for j in range(len(rl[i])):
            temp.append(rl[i][j])
        #print i, " - ",temp
        path = GH_Path(i)
        result.AddRange(temp, path)
    return result

branch = dataTreeToList(branch)


P = []

for br in branch:
    pose_pl = br[3]
    pose_pts = rs.CurvePoints(pose_pl)
    V = []
    for i in range(1,len(pose_pts)):
        vec = rs.VectorCreate(pose_pts[i],pose_pts[0])
        V.append(vec)
    X = V[0]
    Y = V[1]
    Z = V[2]
    P = rs.PlaneFromFrame(pose_pts[0],X,Y)
# ---------- end pose_2 ----------
geometry_2 = PythonScript(branch=orient_2)  # -> G, M, C; inputs branch: tree; same code as geometry
vdisex_4 = VectorDisplayEx(Point=pose_2.O, Vector=pose_2.X, Colour=ColourSwatch(SwatchColor=RGB(255, 0, 0)), Width=2)
vdisex_5 = VectorDisplayEx(Point=pose_2.O, Vector=pose_2.Y, Colour=ColourSwatch(SwatchColor=RGB(72, 255, 0)), Width=2)
vdisex_6 = VectorDisplayEx(Vector=pose_2.Z, Colour=ColourSwatch(SwatchColor=RGB(25, 0, 255)), Width=2)
brep_3 = Brep([geometry_2.G, geometry_2.C])
mesh_2 = Mesh(geometry_2.M)
preview = CustomPreview(Geometry=brep_3, Shader=ColourSwatch(SwatchColor=RGBA(255, 255, 255, 27)))

joint = PythonScript(B=orient_2)  # -> X, P, J; inputs B: tree
# ---------- joint: Python ----------
import rhinoscriptsyntax as rs
import math
import Rhino.Geometry as rg
from clr import AddReference as addr
addr("Grasshopper")
from System import Object
from Grasshopper import DataTree
from Grasshopper.Kernel.Data import GH_Path

def dataTreeToList(aTree):
    theList = []
    for i in range(aTree.BranchCount ):
        thisListPart = []
        thisBranch = aTree.Branch(i)
        for j in range(len(thisBranch)):
            thisListPart.append( thisBranch[j] )
        theList.append(thisListPart)
    return theList

def raggedListToDataTree(raggedList):
    rl = raggedList
    result = DataTree[object]()
    for i in range(len(rl)):
        temp = []
        for j in range(len(rl[i])):
            temp.append(rl[i][j])
        #print i, " - ",temp
        path = GH_Path(i)
        result.AddRange(temp, path)
    return result

B = dataTreeToList(B)

X = []
P = []
J = []

for i in range(len(B)):
    temp = []
    temp2 = []
    temp3 = []
    for j in range(len(B)):
        if i==j: continue
        crv1 = B[i][1]
        crv2 = B[j][1]
        x = rs.CurveCurveIntersection(crv1,crv2,1)
        if x!=None:
            x = x[0][1]
            temp.append(x)
            t = rs.CurveClosestPoint(crv1,x)
            v = rs.CurveTangent(crv1,t)
            t = rs.CurveClosestPoint(crv2,x)
            v2 = rs.CurveTangent(crv2,t)
            n = rs.VectorCrossProduct(v,v2)
            xaxis = rs.VectorCrossProduct(n,v)
            pln = rs.PlaneFromNormal(x,n,xaxis)
            temp2.append(pln)
            temp3.append(j)
    X.append(temp)
    P.append(temp2)
    J.append(temp3)

X = raggedListToDataTree(X)
P = raggedListToDataTree(P)
J = raggedListToDataTree(J)
# ---------- end joint ----------
# ORG
pt = Point(joint.X)

# ----
# JOINT
# JOINT GEOMETRY / MILLING PATH
data = Data(orient_2)
pln_2 = Plane(joint.P)
int = Integer(joint.J)
skel_rad = PythonScript(B=data, P=pln_2, J=int)  # -> C, Cx, R, Rx; inputs B: tree, P: tree, J: tree of Int32
# ---------- skel_rad: Python ----------
import rhinoscriptsyntax as rs
import scriptcontext as sc
import math
import Rhino.Geometry as rg
from clr import AddReference as addr
addr("Grasshopper")
from System import Object
from Grasshopper import DataTree
from Grasshopper.Kernel.Data import GH_Path

def dataTreeToList(aTree):
    theList = []
    for i in range(aTree.BranchCount ):
        thisListPart = []
        thisBranch = aTree.Branch(i)
        for j in range(len(thisBranch)):
            thisListPart.append( thisBranch[j] )
        theList.append(thisListPart)
    return theList

def raggedListToDataTree(raggedList):
    rl = raggedList
    result = DataTree[object]()
    for i in range(len(rl)):
        temp = []
        for j in range(len(rl[i])):
            temp.append(rl[i][j])
        #print i, " - ",temp
        path = GH_Path(i)
        result.AddRange(temp, path)
    return result

def closest_radius(pt,pts,rads):
    mindist = 9999
    r = 99
    for pt2,rad in zip(pts,rads):
        dist = rs.Distance(pt,pt2)
        if dist<mindist:
            mindist = dist
            r = rad
    return r
    
def string_to_list(txt):
    lst = txt.split(',')
    for k in range(len(lst)):
        lst[k] = float(lst[k])
    return lst

B = dataTreeToList(B)
P = dataTreeToList(P)
J = dataTreeToList(J)

C = []
Cx = []
R = []
Rx = []
P2 = []

for branch,plns,js in zip(B,P,J):
    temp1 = []
    temp2 = []
    temp3 = []
    temp4 = []
    crv = branch[1]
    skel_pts = rs.CurvePoints(crv)
    rads = string_to_list(branch[2])
    for j,pln in zip(js,plns):
        crv2 = B[j][1]
        skel_pts2 = rs.CurvePoints(crv2)
        rads2 = string_to_list(B[j][2])
        pt = pln.Origin
        r = closest_radius(pt,skel_pts,rads)
        r2 = closest_radius(pt,skel_pts2,rads2)
        temp1.append(crv)
        temp2.append(crv2)
        temp3.append(r)
        temp4.append(r2)
    C.append(temp1)
    Cx.append(temp2)
    R.append(temp3)
    Rx.append(temp4)

C = raggedListToDataTree(C)
Cx = raggedListToDataTree(Cx)
R = raggedListToDataTree(R)
Rx = raggedListToDataTree(Rx)
# ---------- end skel_rad ----------
joint_points = PythonScript(Org_skeleton_A=skel_rad.C, Org_skeleton_B=skel_rad.Cx, radius_A=skel_rad.R, radius_B=skel_rad.Rx, plane=pln_2)  # -> intersection_point, outer_points, outer_polyline, inner_points, inner_polyline
# ---------- joint_points: Python ----------
import rhinoscriptsyntax as rs

def get_tangent_in_plane(curve,point,plane):
    plane = rs.PlaneFromFrame((0,0,0),plane.XAxis,plane.YAxis)
    t = rs.CurveClosestPoint(curve,point)
    vec = rs.CurveTangent(curve,t)
    vec = rs.AddPoint(vec[0],vec[1],vec[2])
    vec = rs.PlaneClosestPoint(plane,vec)
    vec = rs.VectorUnitize(vec)
    return vec

def makePoints(V):
    P = []
    for vec in V:
        x = vec[0]
        y = vec[1]
        z = vec[2]
        pt = rs.AddPoint((x,y,z))
        P.append(pt)
    return P
### simplify names of input parameters

crv1 = Org_skeleton_A
crv2 = Org_skeleton_B
r1 = float(radius_A)
r2 = float(radius_B)

###

ptX = plane.Origin

v1 = r2*get_tangent_in_plane(crv1,ptX,plane)
v2 = r1*get_tangent_in_plane(crv2,ptX,plane)

###outer 
A = ptX+v1+v2
B = A-2*v1
C = B-2*v2
D = A-2*v2

###inner 
a = ptX+0.5*(v1+v2)
b = a-v1
c = b-v2
d = a-v2

### output
outer_points = makePoints((A,B,C,D))
inner_points = makePoints((a,b,c,d))
outer_polyline = rs.AddPolyline(outer_points)
inner_polyline = rs.AddPolyline(inner_points)
intersection_point = ptX
# ---------- end joint_points ----------
subtraction_2 = Subtraction(A=mill_dia, B=tol)
cutting_paths = PythonScript(
    OUT=joint_points.outer_polyline,
    IN=joint_points.inner_polyline,
    d=subtraction_2,
    z=Slider(0.1, range=0..0.1),
    P=pln_2,
    R=skel_rad.R)  # -> S1, S2, C0; inputs OUT: tree, IN: tree, P: tree, R: tree
# ---------- cutting_paths: Python ----------
import rhinoscriptsyntax as rs
import Rhino.Geometry as rg
from clr import AddReference as addr
addr("Grasshopper")
from System import Object
from Grasshopper import DataTree
from Grasshopper.Kernel.Data import GH_Path

def dataTreeToList(aTree):
    theList = []
    for i in range(aTree.BranchCount ):
        thisListPart = []
        thisBranch = aTree.Branch(i)
        for j in range(len(thisBranch)):
            thisListPart.append( thisBranch[j] )
        theList.append(thisListPart)
    return theList

def raggedListToDataTree(raggedList):
    rl = raggedList
    result = DataTree[object]()
    for i in range(len(rl)):
        temp = []
        for j in range(len(rl[i])):
            temp.append(rl[i][j])
        #print i, " - ",temp
        path = GH_Path(i)
        result.AddRange(temp, path)
    return result

def movePoints(points,vector):
    points2 = []
    for pt in points: points2.append(rs.PointAdd(pt,vector))
    return points2    

def side_cut_points(A,a,B,b,r,d1_,v2,d2_):
    #start lines, and move in by mill bit radius
    line_Aa = rs.MoveObject(rs.AddLine(A,a),r*d1_)
    line_ab = rs.MoveObject(rs.AddLine(a,b),r*v2)
    line_Bb = rs.MoveObject(rs.AddLine(B,b),r*d2_)
    #
    #define path by intersection points of above lines
    P0 = rs.CurveStartPoint(line_Aa)
    p0 = rs.LineLineIntersection(line_Aa,line_ab)[0]
    p1 = rs.LineLineIntersection(line_ab,line_Bb)[0]
    P1 = rs.CurveStartPoint(line_Bb)
    #
    #list of points to define cutting path
    pts = [P0,p0,p1,P1]
    #
    return pts

OUT = dataTreeToList(OUT)
IN = dataTreeToList(IN)
R = dataTreeToList(R)
P = dataTreeToList(P)

S1 = []
S2 = []
C0 = []

r = d/2

for opls,ipls,brs,plns in zip(OUT,IN,R,P):
    temp1 = []
    temp2 = []
    temp3 = []
    for opl,ipl,br,pln in zip(opls,ipls,brs,plns):
        # cutting angle vector
        dir = pln.Normal
        #
        # reference points
        outer_points = rs.CurvePoints(opl)
        inner_points = rs.CurvePoints(ipl)
        A = outer_points[0]
        B = outer_points[1]
        C = outer_points[2]
        D = outer_points[3]
        a = inner_points[0]
        b = inner_points[1]
        c = inner_points[2]
        d = inner_points[3]
        #
        # intersection vectors
        v1 = rs.VectorUnitize(rs.VectorCreate(a,b))
        v2 = rs.VectorUnitize(rs.VectorCreate(a,d))
        #
        #diagonal vectors
        d1 = rs.VectorUnitize(rs.VectorCreate(A,a))
        d2 = rs.VectorUnitize(rs.VectorCreate(B,b))
        #
        #orthogonal to diagonal vectors
        N = rs.VectorCrossProduct(v2,v1)
        d1_ = rs.VectorRotate(d1,-90,N)
        d2_ = rs.VectorRotate(d2,90,N)
        #
        # Side cut points
        #
        pts1 = side_cut_points(A,a,B,b,r,d1_,v2,d2_)
        pts2 = side_cut_points(C,c,D,d,r,-d1_,-v2,-d2_)
        #
        ################ Z ################
        #
        #start height for Z is zero (we set origin at branch center
        #on branch top surface
        v_st = br*dir
        #
        #calculate in how many iterations to move the path down
        h = 2*br-0.1 
        n = int(h/z)
        # move curve down
        path_pts1 = []
        path_pts2 = []
        for i in range(n):
            #move down points
            v_add = z*dir*i
            v = v_st-v_add
            v = rs.AddPoint(v[0],v[1],v[2])
            new_path_points1 = movePoints(pts1,v)
            new_path_points2 = movePoints(pts2,v)
            if i%2==1:
                new_path_points1 = reversed(new_path_points1)
                new_path_points2 = reversed(new_path_points2)
            path_pts1.extend(new_path_points1)
            path_pts2.extend(new_path_points2)
        temp1.append(rs.AddPolyline(path_pts1))
        temp2.append(rs.AddPolyline(path_pts2))
        #
        # CENTER PATH
        #
        ### calculate number of horizontal cut lines
        dist = rs.Distance(a,b)
        n = int(dist/(2*r))+1
        r_ = 0.5*(dist-2*r)/(n-1)
        #
        ### define start point for cut
        p = a-r*v1+0.1*v2
        #
        #list of points to define cutting path
        pts = []
        pts.append(p)
        length = rs.Distance(a,d)+0.2 ############# test later
        for i in range(n):
            p = pts[-1]+(2*(i%2)-1)*length*v2
            p2 = p-2*r_*v1
            pts.append(p)
            if i < n-1: pts.append(p2)
        #
        ####### Z #########
        #
        #calculate numer of cutting laters
        n = int(br/z)
        #add layers to path
        path_pts = []
        for i in range(n):
            #move down points
            v_add = z*dir*i
            v = v_st-v_add
            v = rs.AddPoint(v[0],v[1],v[2])
            new_path_points = movePoints(pts,v)
            if i%2==1:
                new_path_points = reversed(new_path_points)
            path_pts.extend(new_path_points)
        temp3.append(rs.AddPolyline(path_pts))
    S1.append(temp1)
    S2.append(temp2)
    C0.append(temp3)

S1 = raggedListToDataTree(S1)
S2 = raggedListToDataTree(S2)
C0 = raggedListToDataTree(C0)
# ---------- end cutting_paths ----------

# ----
# EXP. TARGET VECS
branch_data_3 = Data(orient_2)
pln_3 = Plane(joint.P)
change_basis = PythonScript(P=pln_3, B=branch_data_3)  # -> V, Vt, names, mrk_pln; inputs P: tree, B: tree
# ---------- change_basis: Python ----------
import rhinoscriptsyntax as rs
import math
import Rhino.Geometry as rg
from clr import AddReference as addr
addr("Grasshopper")
from System import Object
from Grasshopper import DataTree
from Grasshopper.Kernel.Data import GH_Path

def dataTreeToList(aTree):
    theList = []
    for i in range(aTree.BranchCount ):
        thisListPart = []
        thisBranch = aTree.Branch(i)
        for j in range(len(thisBranch)):
            thisListPart.append( thisBranch[j] )
        theList.append(thisListPart)
    return theList

def raggedListToDataTree(raggedList):
    rl = raggedList
    result = DataTree[object]()
    for i in range(len(rl)):
        temp = []
        for j in range(len(rl[i])):
            temp.append(rl[i][j])
        #print i, " - ",temp
        path = GH_Path(i)
        result.AddRange(temp, path)
    return result

def transposeMatrix(m):
    return map(list,zip(*m))

def getMatrixMinor(m,i,j):
    return [row[:j] + row[j+1:] for row in (m[:i]+m[i+1:])]

def getMatrixDeternminant(m):
    #base case for 2x2 matrix
    if len(m) == 2:
        return m[0][0]*m[1][1]-m[0][1]*m[1][0]

    determinant = 0
    for c in range(len(m)):
        determinant += ((-1)**c)*m[0][c]*getMatrixDeternminant(getMatrixMinor(m,0,c))
    return determinant

def getMatrixInverse(m):
    determinant = getMatrixDeternminant(m)
    #special case for 2x2 matrix:
    if len(m) == 2:
        return [[m[1][1]/determinant, -1*m[0][1]/determinant],
                [-1*m[1][0]/determinant, m[0][0]/determinant]]

    #find matrix of cofactors
    cofactors = []
    for r in range(len(m)):
        cofactorRow = []
        for c in range(len(m)):
            minor = getMatrixMinor(m,r,c)
            cofactorRow.append(((-1)**(r+c)) * getMatrixDeternminant(minor))
        cofactors.append(cofactorRow)
    cofactors = transposeMatrix(cofactors)
    for r in range(len(cofactors)):
        for c in range(len(cofactors)):
            cofactors[r][c] = cofactors[r][c]/determinant
    return cofactors

def matmult(m, v):
    nrows = len(m)
    w = [None] * nrows
    for row in range(nrows):
        w[row] = reduce(lambda x,y: x+y, map(lambda x,y: x*y, m[row], v))
    return w

P = dataTreeToList(P)
B = dataTreeToList(B)

V = list()
Vt = list()
names = list()
mrk_pln = []

for plns,branch in zip(P,B):
    temp1 = []
    temp2 = []
    temp3 = []
    pose_pts = rs.CurvePoints(branch[3])
    Org = pose_pts[0]
    X = rs.VectorCreate(pose_pts[1],pose_pts[0])
    Y = rs.VectorCreate(pose_pts[2],pose_pts[0])
    Z = rs.VectorCreate(pose_pts[3],pose_pts[0]) 
    #change of basis matrix
    C = [ [X[0],Y[0],Z[0]] , [X[1],Y[1],Z[1]] , [X[2],Y[2],Z[2]] ]
    C_1 = getMatrixInverse(C)
    ## joint vec
    for i in range(len(plns)):
        name = branch[0]+'_'+str(i+1)
        temp1.append(name)
        #
        pln = plns[i]
        vec = pln.Normal
        vec = [vec[0],vec[1],vec[2]]
        vec = matmult(C_1,vec)
        vec = rs.VectorCreate((vec[0],vec[1],vec[2]),(0,0,0))
        temp2.append(vec)
        # translation vector
        jnt = pln.Origin
        tvec = rs.VectorCreate(jnt,Org)
        tvec = [tvec[0],tvec[1],tvec[2]]
        tvec = matmult(C_1,tvec)
        tvec = rs.VectorCreate((tvec[0],tvec[1],tvec[2]),(0,0,0))
        temp3.append(tvec)
    ## mark vec
    name = branch[0]+'_marks'
    temp1.append(name)
    #
    norm = rs.VectorCreate((0,0,0),(0,0,0))
    yaxis = rs.VectorCreate((0,0,0),(0,0,0))
    n0 = plns[0].Normal
    y0 = plns[0].YAxis
    for pln in plns:
        n = pln.Normal
        ang = rs.VectorAngle(n,n0)
        if ang>90: n = -n
        norm = norm+n
        #
        y = pln.YAxis
        ang = rs.VectorAngle(y,y0)
        if ang>90: y = -y
        yaxis = yaxis+y
    norm = rs.VectorUnitize(norm)
    yaxis = rs.VectorUnitize(yaxis)
    vec = rs.VectorCrossProduct(yaxis,norm)
    vec = rs.VectorUnitize(vec)
    #
    st = rs.CurveStartPoint(branch[1])
    en = rs.CurveEndPoint(branch[1])
    test_pt = rs.CurveMidPoint(rs.AddLine(st,en))
    mid = rs.CurveMidPoint(branch[1])
    test_vec = rs.VectorCreate(mid,test_pt)
    ang = rs.VectorAngle(vec,test_vec)
    if ang<90:
        vec = rs.VectorReverse(vec)
    #
    mrk_pln.append(rs.PlaneFromNormal(mid,vec))
    #
    vec = [vec[0],vec[1],vec[2]]
    vec = matmult(C_1,vec)
    vec = rs.VectorCreate((vec[0],vec[1],vec[2]),(0,0,0))
    temp2.append(vec)
    # translation vector
    tvec = rs.VectorCreate(mid,Org)
    tvec = [tvec[0],tvec[1],tvec[2]]
    tvec = matmult(C_1,tvec)
    tvec = rs.VectorCreate((tvec[0],tvec[1],tvec[2]),(0,0,0))
    temp3.append(tvec)
    #
    names.append(temp1)
    V.append(temp2)
    Vt.append(temp3)



V = raggedListToDataTree(V)
Vt = raggedListToDataTree(Vt)
names = raggedListToDataTree(names)
# ---------- end change_basis ----------
test = PythonScript(B=branch_data_3, Vb=change_basis.Vt, P=pln_3)  # -> A, Vw; inputs B: tree, Vb: tree, P: tree
# ---------- test: Python ----------
import rhinoscriptsyntax as rs
import math
import Rhino.Geometry as rg
from clr import AddReference as addr
addr("Grasshopper")
from System import Object
from Grasshopper import DataTree
from Grasshopper.Kernel.Data import GH_Path

def dataTreeToList(aTree):
    theList = []
    for i in range(aTree.BranchCount ):
        thisListPart = []
        thisBranch = aTree.Branch(i)
        for j in range(len(thisBranch)):
            thisListPart.append( thisBranch[j] )
        theList.append(thisListPart)
    return theList

def raggedListToDataTree(raggedList):
    rl = raggedList
    result = DataTree[object]()
    for i in range(len(rl)):
        temp = []
        for j in range(len(rl[i])):
            temp.append(rl[i][j])
        #print i, " - ",temp
        path = GH_Path(i)
        result.AddRange(temp, path)
    return result

B = dataTreeToList(B)
Vb = dataTreeToList(Vb)
P = dataTreeToList(P)

A = []
Vw = []

for branch,vecs,plns in zip(B,Vb,P):
    pose_pts = rs.CurvePoints(branch[3])
    X = rs.VectorCreate(pose_pts[1],pose_pts[0])
    Y = rs.VectorCreate(pose_pts[2],pose_pts[0])
    Z = rs.VectorCreate(pose_pts[3],pose_pts[0]) 
    for j in range(len(vecs)):
        vec = vecs[j]
        if j<2: A.append(plns[j].Origin)
        else: A.append(rs.CurveMidPoint(branch[1]))
        vwx = X*vec[0]
        vwy = Y*vec[1]
        vwz = Z*vec[2]
        p = vwx+vwy+vwz
        p = p
        p = rs.AddPoint(p[0],p[1],p[2])
        vw = rs.VectorCreate(p,(0,0,0))
        Vw.append(rs.VectorReverse(vw))
# ---------- end test ----------
test_2 = PythonScript(B=branch_data_3, Vb=change_basis.V, P=pln_3)  # -> A, Vw; inputs B: tree, Vb: tree, P: tree
# ---------- test_2: Python ----------
import rhinoscriptsyntax as rs
import math
import Rhino.Geometry as rg
from clr import AddReference as addr
addr("Grasshopper")
from System import Object
from Grasshopper import DataTree
from Grasshopper.Kernel.Data import GH_Path

def dataTreeToList(aTree):
    theList = []
    for i in range(aTree.BranchCount ):
        thisListPart = []
        thisBranch = aTree.Branch(i)
        for j in range(len(thisBranch)):
            thisListPart.append( thisBranch[j] )
        theList.append(thisListPart)
    return theList

def raggedListToDataTree(raggedList):
    rl = raggedList
    result = DataTree[object]()
    for i in range(len(rl)):
        temp = []
        for j in range(len(rl[i])):
            temp.append(rl[i][j])
        #print i, " - ",temp
        path = GH_Path(i)
        result.AddRange(temp, path)
    return result

B = dataTreeToList(B)
Vb = dataTreeToList(Vb)
P = dataTreeToList(P)

A = []
Vw = []

for branch,vecs,plns in zip(B,Vb,P):
    pose_pts = rs.CurvePoints(branch[3])
    X = rs.VectorCreate(pose_pts[1],pose_pts[0])
    Y = rs.VectorCreate(pose_pts[2],pose_pts[0])
    Z = rs.VectorCreate(pose_pts[3],pose_pts[0]) 
    for j in range(len(vecs)):
        vec = vecs[j]
        if j<2: A.append(plns[j].Origin)
        else: A.append(rs.CurveMidPoint(branch[1]))
        vwx = X*vec[0]
        vwy = Y*vec[1]
        vwz = Z*vec[2]
        p = vwx+vwy+vwz
        p = 5*p
        p = rs.AddPoint(p[0],p[1],p[2])
        vw = rs.VectorCreate(p,(0,0,0))
        Vw.append(vw)
# ---------- end test_2 ----------
export = PythonScript(path=panel, V=change_basis.V, Vt=change_basis.Vt, N=change_basis.names)  # inputs V: list, Vt: list, N: list
# ---------- export: Python ----------
import rhinoscriptsyntax as rs

def sr(num):
    num = round(num,3)
    txt = str(num)
    return txt

for name,vec,tvec in zip(N,V,Vt):
    file = open(str(path)+'\\1_cut_vec_'+name+'.txt','w')
    ###initialization
    file.write(sr(vec[0])+','+sr(vec[1])+','+sr(vec[2])+', "Target direction vector"\n')
    file.write(sr(0.01*tvec[0])+','+sr(0.01*tvec[1])+','+sr(0.01*tvec[2])+', "Translation vector (meters)"\n') 
    file.close()
# ---------- end export ----------
vdis_2 = VectorDisplay(Anchor=test_2.A, Vector=test_2.Vw)
vdis_3 = VectorDisplay(Anchor=test.A, Vector=test.Vw)

branch_name = Panel(import_2.branch_name)
branch_data_4 = Data(orient_2)
index = PythonScript(name=import_2.branch_name, B=branch_data_4)  # -> i; inputs B: tree
# ---------- index: Python ----------
import rhinoscriptsyntax as rs
import Rhino.Geometry as rg
from clr import AddReference as addr
addr("Grasshopper")
from System import Object
from Grasshopper import DataTree
from Grasshopper.Kernel.Data import GH_Path

def dataTreeToList(aTree):
    theList = []
    for i in range(aTree.BranchCount ):
        thisListPart = []
        thisBranch = aTree.Branch(i)
        for j in range(len(thisBranch)):
            thisListPart.append( thisBranch[j] )
        theList.append(thisListPart)
    return theList

B = dataTreeToList(B)
index = None

for i in range(len(B)):
    if name == B[i][0]:
        index = i
        break

i = index
# ---------- end index ----------
flip = FlipMatrix(Data=branch_data_4)
branch = ListItem(List=flip, Index=index, Wrap=True)  # -> flatten(Item)
flip_2 = FlipMatrix(Data=joint.P)
flip_3 = FlipMatrix(Data=skel_rad.R)
jnt_plns = ListItem(List=flip_2, Index=index, Wrap=True)  # -> flatten(Item)
loc_rads = ListItem(List=flip_3, Index=index, Wrap=True)  # -> flatten(Item)
geometry_3 = PythonScript(branch=branch)  # -> G, M, C; inputs branch: tree; same code as geometry
brep_4 = Brep([geometry_3.G, geometry_3.C])

item_4 = ListItem(List=change_basis.mrk_pln, Index=index, Wrap=True)

int_2 = Integer(import_2.joint_index)
jnt_pln = TreeItem(Tree=joint.P, Path=index, Index=int_2, Wrap=True)
side_1 = TreeItem(Tree=cutting_paths.S1, Path=index, Index=int_2, Wrap=True)
side_2 = TreeItem(Tree=cutting_paths.S2, Path=index, Index=int_2, Wrap=True)
ctr_cut = TreeItem(Tree=cutting_paths.C0, Path=index, Index=int_2, Wrap=True)
loc_rad = TreeItem(Tree=skel_rad.R, Path=index, Index=int_2, Wrap=True)

sel = PythonScript(jnt_ind=import_2.joint_index, mrk_pln=item_4, jnt_pln=jnt_pln)  # -> pln
# ---------- sel: Python ----------
if jnt_ind>=0:
    pln = jnt_pln
else:
    pln = mrk_pln
# ---------- end sel ----------
pose_3 = PythonScript(B=branch)  # -> P; inputs B: list
# ---------- pose_3: Python ----------
import rhinoscriptsyntax as rs

P = []


pose_pl = B[3]
pose_pts = rs.CurvePoints(pose_pl)
V = []
for i in range(1,len(pose_pts)):
    vec = rs.VectorCreate(pose_pts[i],pose_pts[0])
    V.append(vec)
P = rs.PlaneFromFrame(pose_pts[0],V[0],V[1])
# ---------- end pose_3 ----------
orient_3 = Orient(Geometry=sel, Source=pose_3, Target=pln)  # -> Geometry, Transform
cut_v = PythonScript(P=orient_3.Geometry)  # -> A, V
# ---------- cut_v: Python ----------
import rhinoscriptsyntax as rs

A = P.Origin
V = 10*P.Normal
# ---------- end cut_v ----------
cut_v_2 = PythonScript(P=sel)  # -> A, V; same code as cut_v
vdisex_7 = VectorDisplayEx(Point=cut_v.A, Vector=cut_v.V, Colour=swatch_2, Width=4)
vdisex_8 = VectorDisplayEx(Point=cut_v_2.A, Vector=cut_v_2.V, Colour=swatch_2, Width=4)

# ----
# POSE
corr_z = PythonScript(pln=import_2.pln)  # -> pln
# ---------- corr_z: Python ----------
import rhinoscriptsyntax as rs

O = pln.Origin
X = pln.XAxis
Y = pln.YAxis

X = rs.AddPoint(X[0],X[1],0)
Y = rs.AddPoint(Y[0],Y[1],0)

X = rs.VectorCreate(X,(0,0,0))
Y = rs.VectorCreate(Y,(0,0,0))

X = rs.VectorUnitize(X)
Y = rs.VectorUnitize(Y)

pln = rs.PlaneFromFrame(O,X,Y)
# ---------- end corr_z ----------
# FAB
ref = PythonScript(B=branch)  # -> pln; inputs B: list
# ---------- ref: Python ----------
import rhinoscriptsyntax as rs

pose_pts = rs.CurvePoints(B[3])
O = pose_pts[0]
O = rs.AddPoint(O[0],O[1],O[2])
X = rs.VectorCreate(pose_pts[1],pose_pts[0])
Y = rs.VectorCreate(pose_pts[2],pose_pts[0])
Z = rs.VectorCreate(pose_pts[3],pose_pts[0]) 

pln = rs.PlaneFromFrame(O,X,Y)
print rs.VectorAngle(Z,pln.Normal)
# ---------- end ref ----------
orient_4 = PythonScript(branch=branch, REF=ref, TAR=import_2.pln)  # -> branch; inputs branch: tree, REF: list, TAR: list; same code as orient
orient_5 = PythonScript(branch=branch, REF=ref, TAR=corr_z)  # -> branch; inputs branch: tree, REF: list, TAR: list; same code as orient
geometry_4 = PythonScript(branch=orient_4)  # -> G, M, C; inputs branch: tree; same code as geometry
geometry_5 = PythonScript(branch=orient_5)  # -> G, M, C; inputs branch: tree; same code as geometry
ideal_pose_brep = Brep([geometry_5.G, geometry_5.C])
actual_pose_brep = Brep([geometry_4.G, geometry_4.C])

pose_4 = PythonScript(B=orient_4)  # -> P; inputs B: list; same code as pose_3
deplane = DeconstructPlane(Plane=pose_4)  # -> Origin, XAxis, YAxis, ZAxis
pl_origin = PlaneOrigin(Base=xy, Origin=deplane.Origin)
deplane_2 = DeconstructPlane(Plane=pl_origin)  # -> Origin, XAxis, YAxis, ZAxis
vdisex_9 = VectorDisplayEx(Point=deplane.Origin, Vector=expr("5*x", import_2.X), Colour=ColourSwatch(SwatchColor=RGB(255, 0, 0)), Width=2)
vdisex_10 = VectorDisplayEx(Point=deplane.Origin, Vector=expr("5*x", import_2.Y), Colour=ColourSwatch(SwatchColor=RGB(72, 255, 0)), Width=2)
vdisex_11 = VectorDisplayEx(Point=deplane.Origin, Vector=expr("5*x", import_2.Z), Colour=ColourSwatch(SwatchColor=RGB(25, 0, 255)), Width=2)
vdisex_12 = VectorDisplayEx(Point=deplane_2.Origin, Vector=deplane_2.XAxis, Colour=ColourSwatch(SwatchColor=RGB(255, 0, 0)), Width=2)
vdisex_13 = VectorDisplayEx(Point=deplane_2.Origin, Vector=deplane_2.YAxis, Colour=ColourSwatch(SwatchColor=RGB(72, 255, 0)), Width=2)
vdisex_14 = VectorDisplayEx(Point=deplane_2.Origin, Vector=deplane_2.ZAxis, Colour=ColourSwatch(SwatchColor=RGB(25, 0, 255)), Width=2)

# ----
# JOINTS
orient_6 = Orient(Geometry=jnt_pln, Source=ref, Target=import_2.pln_jnt)  # -> Geometry, Transform
orient_7 = Orient(Geometry=side_1, Source=ref, Target=import_2.pln_jnt)  # -> Geometry, Transform
orient_8 = Orient(Geometry=side_2, Source=ref, Target=import_2.pln_jnt)  # -> Geometry, Transform
orient_9 = Orient(Geometry=ctr_cut, Source=ref, Target=import_2.pln_jnt)  # -> Geometry, Transform
corr_z_2 = PythonScript(pln=orient_6.Geometry)  # -> pln; same code as corr_z
orient_10 = Orient(Geometry=orient_7.Geometry, Source=orient_6.Geometry, Target=corr_z_2)  # -> Geometry, Transform
orient_11 = Orient(Geometry=orient_8.Geometry, Source=orient_6.Geometry, Target=corr_z_2)  # -> Geometry, Transform
orient_12 = Orient(Geometry=orient_9.Geometry, Source=orient_6.Geometry, Target=corr_z_2)  # -> Geometry, Transform
pt_2 = Point(orient_6.Geometry)
compose_path_cm = PythonScript(
    org=subtraction,
    ctr=pt_2,
    rad=loc_rad,
    path1=orient_10.Geometry,
    path2=orient_11.Geometry,
    pathC=orient_12.Geometry,
    move_h=Slider(1, range=0..1))  # -> P, PL; inputs org: Point3d, ctr: Point3d
# ---------- compose_path_cm: Python ----------
import rhinoscriptsyntax as rs

pts = []

h = ctr[2]+rad+move_h
h_0 = ctr[2]+rad

#
pts1 = rs.CurvePoints(path1)
pts2 = rs.CurvePoints(path2)
pts3 = rs.CurvePoints(pathC)
#
#adjust height
pts.append(rs.AddPoint(org[0],org[1],org[2]))
pts.append(rs.AddPoint(org[0],org[1],h))
#
# go to joint center point
pts.append(rs.AddPoint(ctr[0],ctr[1],h))
pts.append(rs.AddPoint(ctr[0],ctr[1],h_0))
pts.append(rs.AddPoint(ctr[0],ctr[1],h))
#
# go to start of p1, add path, move up
pts.append(rs.AddPoint(pts1[0][0],pts1[0][1],h))
pts.extend(pts1)
pts.append(rs.AddPoint(pts1[-1][0],pts1[-1][1],h))
#
# go to start of p2, add path, move up
pts.append(rs.AddPoint(pts2[0][0],pts2[0][1],h))
pts.extend(pts2)
pts.append(rs.AddPoint(pts2[-1][0],pts2[-1][1],h))
#
# go to start of p3, add path, move up
pts.append(rs.AddPoint(pts3[0][0],pts3[0][1],h))
pts.extend(pts3)
pts.append(rs.AddPoint(pts3[-1][0],pts3[-1][1],h))
#
polyline = rs.AddPolyline(pts)

PL = polyline
P = pts
# ---------- end compose_path_cm ----------
crv_2 = Curve(compose_path_cm.PL)

# ----
# MARKS
orient_13 = Orient(Geometry=jnt_plns, Source=ref, Target=import_2.pln_mrk)  # -> Geometry, Transform
corr = PythonScript(pln=orient_13.Geometry)  # -> pln
# ---------- corr: Python ----------
import rhinoscriptsyntax as rs

O = pln.Origin
X = pln.XAxis
Y = pln.YAxis

X = (0,0,X[2])
X = rs.VectorUnitize(X)

pln = rs.PlaneFromFrame(O,X,Y)
# ---------- end corr ----------
rad_vec = PythonScript(P=corr, R=loc_rads)  # -> V
# ---------- rad_vec: Python ----------
import rhinoscriptsyntax as rs

z = P.Normal
V = z*R
# ---------- end rad_vec ----------
pt_3 = Point(orient_13.Geometry)
move = Move(Geometry=pt_3, Motion=rad_vec)  # -> Geometry, Transform
top = PythonScript(B=orient_4)  # -> skel_pts, skel_rads, max_z; inputs B: list
# ---------- top: Python ----------
import rhinoscriptsyntax as rs

def string_to_list(txt):
    lst = txt.split(',')
    for k in range(len(lst)):
        lst[k] = float(lst[k])
    return lst

pts = rs.DivideCurve(B[1],rs.CurvePointCount(B[1])-1)
rads = string_to_list(B[2])

max_z = -9999999

for pt,r in zip(pts,rads):
    z = pt[2]+r
    if z>max_z:
        max_z = z

skel_pts = pts
skel_rads = rads
# ---------- end top ----------

# ----
# CALIBRATION
calibration = PythonScript(org=subtraction, skel_pts=top.skel_pts, skel_rads=top.skel_rads, rads=loc_rads)  # -> st, en; inputs org: Point3d, skel_pts: list of Point3d, skel_rads: list, rads: list
# ---------- calibration: Python ----------
import rhinoscriptsyntax as rs

dist1 = rs.Distance(skel_pts[0],org)
dist2 = rs.Distance(skel_pts[-1],org)
if dist2<dist1: 
    skel_pts.reverse()
    skel_rads.reverse()
#add

st = rs.AddPoint(skel_pts[0][0],skel_pts[0][1],skel_pts[0][2]+skel_rads[0])
en = rs.AddPoint(skel_pts[-1][0],skel_pts[-1][1],skel_pts[-1][2]+skel_rads[-1])
# ---------- end calibration ----------
panel_5 = Panel("""8,
42,
-23""")
panel_6 = Panel("""23,
-7,
-25""")
ln = Line(StartPoint=calibration.st, EndPoint=calibration.en)
pt_4 = Point(panel_5)
pt_5 = Point(panel_6)
ln_2 = Line(StartPoint=pt_5, EndPoint=pt_4)
pln_4 = PythonScript(L=ln)  # -> P
# ---------- pln_4: Python ----------
import rhinoscriptsyntax as rs

mid = rs.CurveMidPoint(L)

st = rs.CurveStartPoint(L)
en = rs.CurveEndPoint(L)

vec = rs.VectorCreate(en,st)
vec2 = rs.VectorCrossProduct(vec,(0,0,1))

P = rs.PlaneFromFrame(mid,vec,vec2)
# ---------- end pln_4 ----------
pln_5 = PythonScript(L=ln_2)  # -> P; same code as pln_4
python_2 = PythonScript(ref=pln_4, tar=pln_5, cal=calibrating)  # -> ref, tar
# ---------- python_2: Python ----------
if cal == True: tar = ref
# ---------- end python_2 ----------
orient_14 = PythonScript(branch=orient_4, REF=python_2.ref, TAR=python_2.tar)  # -> branch; inputs branch: tree, REF: list, TAR: list; same code as orient
orient_15 = Orient(Geometry=move.Geometry, Source=python_2.ref, Target=python_2.tar)  # -> Geometry, Transform
geometry_6 = PythonScript(branch=orient_14)  # -> G, M, C; inputs branch: tree; same code as geometry
top_2 = PythonScript(B=orient_14)  # -> skel_pts, skel_rads, max_z; inputs B: list; same code as top
actual_pose_after_calibration_brep = Brep([geometry_6.G, geometry_6.C])

compose_path_cm_2 = PythonScript(
    org=subtraction,
    jnts=orient_15.Geometry,
    skel_pts=top_2.skel_pts,
    skel_rads=top_2.skel_rads,
    rads=loc_rads,
    move_h=Slider(3, range=0..10),
    max_z=top_2.max_z,
    calibrating=calibrating)  # -> P, PL; inputs org: Point3d, jnts: list of Point3d, skel_pts: list of Point3d, skel_rads: list, rads: list
# ---------- compose_path_cm_2: Python ----------
import rhinoscriptsyntax as rs

pts = []

h = max_z+move_h
extra = 3 #0.5

#adjust height
#pts.append(rs.AddPoint(org[0],org[1],org[2]))
#pts.append(rs.AddPoint(org[0],org[1],h))
#
# go to start point, go down low, follow skeleton,go up
#ensure efficient direction
dist1 = rs.Distance(skel_pts[0],org)
dist2 = rs.Distance(skel_pts[-1],org)
if dist2<dist1: 
    skel_pts.reverse()
    skel_rads.reverse()
#add
#
if calibrating == False:
    pts.append(rs.AddPoint(skel_pts[0][0],skel_pts[0][1],h))
    for i in range(len(skel_pts)):
        pt = skel_pts[i]
        r = skel_rads[i]
        pts.append(rs.AddPoint(pt[0],pt[1],pt[2]+r+extra))
    pts.append(rs.AddPoint(skel_pts[-1][0],skel_pts[-1][1],h))
    # joint points
    #ensure efficient direction
    dist1 = rs.Distance(skel_pts[-1],jnts[0])
    dist2 = rs.Distance(skel_pts[-1],jnts[-1])
    if dist2<dist1: jnts.reverse()
    #add
    for jnt,rad in zip(jnts,rads):
        # go to joint point, move down, move up
        pts.append(rs.AddPoint(jnt[0],jnt[1],h))
        pts.append(rs.AddPoint(jnt[0],jnt[1],jnt[2]+rad))
        pts.append(rs.AddPoint(jnt[0],jnt[1],jnt[2]-rad+0.2))
        pts.append(rs.AddPoint(jnt[0],jnt[1],h))
else:
    pts.append(rs.AddPoint(skel_pts[0][0],skel_pts[0][1],h))
    pts.append(rs.AddPoint(skel_pts[0][0],skel_pts[0][1],skel_pts[0][2]+skel_rads[0]+extra))
    if skel_pts[0][2]<skel_pts[-1][2]:
        pts.append(rs.AddPoint(skel_pts[0][0],skel_pts[0][1],skel_pts[-1][2]+skel_rads[-1]+extra))
    pts.append(rs.AddPoint(skel_pts[-1][0],skel_pts[-1][1],skel_pts[-1][2]+skel_rads[-1]+extra))
    pts.append(rs.AddPoint(skel_pts[-1][0],skel_pts[-1][1],h))
polyline = rs.AddPolyline(pts)

PL = polyline
P = pts
# ---------- end compose_path_cm_2 ----------
crv_3 = Curve(compose_path_cm_2.PL)

select = PythonScript(P_mark=compose_path_cm_2.P, P_joint=compose_path_cm.P)  # -> P; inputs P_mark: list, P_joint: list
# ---------- select: Python ----------
if P_mark == None or len(P_mark)==0: P = P_joint
else: P = P_mark
# ---------- end select ----------
path_txt = Text(panel)
export_2 = Button()
join = TextJoin(Text=[path_txt, "\gcode"])
txt = Text("joint")
panel_7 = Panel(join)
export_g_code_mm = PythonScript(file=txt, path=panel_7, path_points=select, org=subtraction, speed=Slider(400, range=0..1000), Refresh=export_2)  # -> a; inputs file: list, path_points: tree of Point3d, org: Point3d
# ---------- export_g_code_mm: Python ----------
import rhinoscriptsyntax as rs
import math
import Rhino.Geometry as rg
from clr import AddReference as addr
addr("Grasshopper")
from System import Object
from Grasshopper import DataTree
from Grasshopper.Kernel.Data import GH_Path

def dataTreeToList(aTree):
    theList = []
    for i in range(aTree.BranchCount ):
        thisListPart = []
        thisBranch = aTree.Branch(i)
        for j in range(len(thisBranch)):
            thisListPart.append( thisBranch[j] )
        theList.append(thisListPart)
    return theList

path_points = dataTreeToList(path_points)


for file_name,pts in zip(file,path_points):
    d = 2 #=precision
    file = open(str(path)+'\\'+str(file_name)+".gcode","w")
    ###initialization
    file.write("%\n")
    file.write("G90(Absolute [G91 is incremental])\n") 
    file.write("G21(set unit[mm])\n") 
    file.write("G54\n") 
    file.write("F1000.0S6000 (Feeding 2000mm/min, Spindle 6000rpm)\n") 
    file.write("G17(set XY plane for circle path)\n") 
    file.write("M03 (spindle start)\n") 
    ###content
    x_ = str(9999999999)
    y_ = str(9999999999)
    z_ = str(9999999999)
    for pt in pts:
        #move point relative to local origin
        pt = rs.PointSubtract(pt,org)
        #convert from cm to mm
        x = str(round(10*pt[0],d))
        y = str(round(10*pt[1],d))
        z = str(round(10*pt[2],d))
        if x_!=x or y_!=y: file.write("G01 X "+x+" Y "+y+" F "+str(speed)+"\n")
        if z_!=z: file.write("G01 Z "+z+" F "+str(speed)+"\n")
        x_ = x
        y_ = y
        z_ = z
    ###end
    file.write("M05 (Spindle stop)\n") 
    file.write("M02(end of program)\n") 
    file.write("%\n") 
    file.close()
# ---------- end export_g_code_mm ----------
import_3 = Button()
import_g_code = PythonScript(file=txt, path=panel_7, org=subtraction, refresh=export_g_code_mm, refresh2=import_3)  # -> cut_path; inputs org: Point3d
# ---------- import_g_code: Python ----------
import rhinoscriptsyntax as rs
import Rhino as rc


print "Importing..."
file = open(str(path)+'\\'+str(file)+".gcode","r")
lines = file.readlines()
pts = []
x = 0
y = 0
z = 0
for line in lines:
    items = line.split(" ") 
    if items!=None and items[0] == "G01":
        for i in range(1,len(items)):
            item = items[i]
            if item=="X": x = 0.1*float(items[i+1])
            if item=="Y": y = 0.1*float(items[i+1])
            if item=="Z": z = 0.1*float(items[i+1])
        pt = rs.AddPoint(x,y,z)
        pts.append(pt)
cut_path = rs.AddPolyline(pts)
rs.MoveObject(cut_path,org)
file.close()
# ---------- end import_g_code ----------

# ==== cluster Cluster
F = ClusterInput()
A = ClusterInput()
P = ClusterInput()
F_2 = ClusterInput()
A_2 = ClusterInput()
Z = UnitZ(Factor=F)
division = Division(A=A, B=2)
cir = Circle(Plane=P, Radius=division)
Z_2 = UnitZ(Factor=F_2)
addition = Addition(A=A_2, B=Z_2)
rectangle = Rectangle(Plane=addition, XSize=Domain(-3.5, 3.5), YSize=Domain(-3.5, 3.5), Radius=0)  # -> Rectangle, Length
extr = Extrude(Base=rectangle.Rectangle, Direction=Z)
cap = CapHoles(Brep=extr)
extr_2 = Extrude(Base=cir, Direction=Z_2)
B = ClusterOutput(cap)
E = ClusterOutput(extr_2)

# ==== cluster ExtSrf
number_slider = Slider(20, range=0..200)
number_slider_2 = Slider(1, range=0..1)
number_slider_3 = Slider(20, range=0..200)
number_slider_4 = Slider(50, range=0..100)
S = ClusterInput()
divide_s = PythonScript(S=S, U=number_slider_4, V=number_slider_4)  # -> simplify(pts); inputs S: Surface
# ---------- divide_s: Python ----------
import rhinoscriptsyntax as rs

import Rhino.Geometry as rg
from clr import AddReference as addr
addr("Grasshopper")

from System import Object
from Grasshopper import DataTree
from Grasshopper.Kernel.Data import GH_Path


def raggedListToDataTree(raggedList):
    rl = raggedList
    result = DataTree[object]()
    for i in range(len(rl)):
        temp = []
        for j in range(len(rl[i])):
            temp.append(rl[i][j])
        #print i, " - ",temp
        path = GH_Path(i)
        result.AddRange(temp, path)
    return result



u_step = 1.00/U
v_step = 1.00/V

U = int(U)
V = int(V)

# Creat grid of points on surface
pts = []
for i in range(U+1):
    u_ = u_step * i
    temp = []
    for j in range(V+1):
        v_ = v_step * j
        (u,v) = rs.SurfaceParameter(S,(u_,v_))
        pt = rs.EvaluateSurface(S, u, v,)
        temp.append(pt)
    pts.append(temp)

# Make division equidistance
pts = zip(*pts)
for i in range(len(pts)):
    crv = rs.AddInterpCrvOnSrf(S,pts[i])
    pts[i] = rs.DivideCurve(crv,U)
    pts[i].append(rs.CurveEndPoint(crv))
pts = zip(*pts)
for i in range(len(pts)):
    crv = rs.AddInterpCrvOnSrf(S,pts[i])
    pts[i] = rs.DivideCurve(crv,V)
    pts[i].append(rs.CurveEndPoint(crv))


pts = raggedListToDataTree(pts)
# ---------- end divide_s ----------
nurbs = NurbsCurve(Vertices=divide_s, Degree=3, Periodic=False)  # -> flatten(Curve), Length, Domain
ext = ExtendCurve(Curve=nurbs.Curve, Type=0, Start=number_slider, End=number_slider)  # -> flatten(Curve)
divide = DivideCurve(Curve=ext, Count=number_slider_4, Kinks=False)  # -> Points, Tangents, Parameters
flip = FlipMatrix(Data=divide.Points)
nurbs_2 = NurbsCurve(Vertices=flip, Degree=3, Periodic=False)  # -> flatten(Curve), Length, Domain
ext_2 = ExtendCurve(Curve=nurbs_2.Curve, Type=0, Start=number_slider_3, End=number_slider_3)  # -> flatten(Curve)
divide_2 = DivideCurve(Curve=ext_2, Count=number_slider_4, Kinks=False)  # -> Points, Tangents, Parameters
nurbs_3 = NurbsCurve(Vertices=divide_2.Points, Degree=3, Periodic=False)  # -> flatten(Curve), Length, Domain
loft = Loft(Curves=nurbs_3.Curve, Options={Adjust=False, Closed=False, LoftEnds=0, LoftSimp=0, LoftType=0, Rebuild=10, Refit=0.01})
L = ClusterOutput(loft)

# ==== cluster ClusterEdgePts
S = ClusterInput()
P = ClusterInput()
number_slider = Slider(1, range=0..1)
edgepts = PythonScript(S=S, P=P, d=number_slider)  # -> P; inputs S: Surface, P: tree
# ---------- edgepts: Python ----------
import rhinoscriptsyntax as rs
import math
import Rhino.Geometry as rg
from clr import AddReference as addr
addr("Grasshopper")
from System import Object
from Grasshopper import DataTree
from Grasshopper.Kernel.Data import GH_Path

def dataTreeToList(aTree):
    theList = []
    for i in range(aTree.BranchCount ):
        thisListPart = []
        thisBranch = aTree.Branch(i)
        for j in range(len(thisBranch)):
            thisListPart.append( thisBranch[j] )
        theList.append(thisListPart)
    return theList
    
def raggedListToDataTree(raggedList):
    rl = raggedList
    result = DataTree[object]()
    for i in range(len(rl)):
        temp = []
        for j in range(len(rl[i])):
            temp.append(rl[i][j])
        #print i, " - ",temp
        path = GH_Path(i)
        result.AddRange(temp, path)
    return result

def point_to_surface(pt):
    (u,v) = rs.SurfaceClosestPoint(S,pt)
    pt = rs.EvaluateSurface(S,u,v)
    return pt

P = dataTreeToList(P)

for i in range(len(P)):
    p0 = P[i][0]
    p1 = P[i][1]
    vec = d*rs.VectorCreate(p0,p1)
    p_new = rs.VectorAdd(p0,vec)
    p_new = rs.AddPoint(p_new[0],p_new[1],p_new[2])
    P[i].insert(0,p_new)

for i in range(len(P)):
    p0 = P[i][-1]
    p1 = P[i][-2]
    vec = d*rs.VectorCreate(p0,p1)
    p_new = rs.VectorAdd(p0,vec)
    p_new = rs.AddPoint(p_new[0],p_new[1],p_new[2])
    P[i].append(p_new)



P = raggedListToDataTree(P)
# ---------- end edgepts ----------
flip = FlipMatrix(Data=edgepts)
edgepts_2 = PythonScript(P=flip, d=number_slider)  # -> P; inputs P: tree; same code as edgepts
flip_2 = FlipMatrix(Data=edgepts_2)
D = ClusterOutput(flip_2)

# ==== cluster Cluster_2
number_slider = Slider(0, range=0..2)
data = ClusterInput()
data_2 = Data(data)
number_slider_2 = ClusterOutput(number_slider)
item = TreeItem(Tree=data_2, Path=number_slider, Index=Slider(0, range=0..100), Wrap=True)
item_2 = TreeItem(Tree=data_2, Path=number_slider, Index=Slider(1, range=0..1), Wrap=True)
item_3 = TreeItem(Tree=data_2, Path=number_slider, Index=Slider(2, range=0..10), Wrap=True)
item_4 = TreeItem(Tree=data_2, Path=number_slider, Index=Slider(3, range=0..10), Wrap=True)
number_slider_3 = Slider(5, range=0..10)
E = ClusterOutput(item)
multiplication = Multiplication(A=item_3, B=number_slider_3)
multiplication_2 = Multiplication(A=item_2, B=number_slider_3)
multiplication_3 = Multiplication(A=item_4, B=number_slider_3)
R = ClusterOutput(multiplication)
R_2 = ClusterOutput(multiplication_2)
R_3 = ClusterOutput(multiplication_3)
